# Grasshopper definition GFFT.gh (Grasshopper 1.0.8)
# plug-ins: RhinoCodePluginGH, Pufferfish, Kangaroo Components

# ----
# CMMKM
# 1. Input geometries
# architettura e design
# Method
# Gridshell Form Finding Tool v.1.1
# Arch. Pierfrancesco Corbo, Arch. Andrea Fiore, PhD Arch. Daniele Lancia, Arch. Alessio Pazzanese
list = ValueList({"Custom": 0, "Grid Maker": 1}, selected="Grid Maker")

# ----
# 1b. Custom grid parameters
# Dimension
# Rotate grid
grid_dimension = ValueList({"25 cm": 0.25, "45 cm": 0.45, "50 cm": 0.50, "55 cm": 0.55, "60 cm": 0.60, "70 cm": 0.70, "100 cm": 1.00}, selected="60 cm")
# Only required if you choose the custom grid method.
angle = Slider(34.06, range=0..100)

# ----
# 2. Kangaroo simulation
# 1. Simulation ON/OFF
sim_step = ValueList({"PlaneGrid": 0, "Simulation ON": 2}, selected="PlaneGrid")

# ----
# (turn off  3d visualization when starting simulation)
# 3. Start/pause simulation
# Control the simulation process, minimum 100.000 iterations recommended
timer = Timer(Interval=20, TimerInterval=20, Target=[kangaroo, counter])  # disabled

# ----
# 2. Pull up
pull_up = Button(ExpressionNormal="True", ExpressionPressed="False")

# ----
# Trim geometry
# Grid Maker
# Custom
grid_maker_grid_trim_geo = Geometry([<curve referenced from the Rhino model> x63])
# Select grid modeling method and reference the required geometries.
# Choose "Grid Maker" if you are referencing a grid made by Grid Maker,
# select "Custom" if you prefer to generate a new grid from scratch.
custom_trim_geometry = Curve(<curve referenced from the Rhino model>)

# ----
# Move center point
move_center_point = MDSlider(
    SliderMode=0,
    slider_value=Point(0.7511863524, 0.7279543533, 0.5),
    x_domain=Domain(0, 1),
    y_domain=Domain(0, 1),
    z_domain=Domain(0, 1))

# ----
# Ground costrain/points
curve_for_ground_points_selection = Curve(graft([<curve referenced from the Rhino model> x2]))
curve_constrain = Curve(graft([<curve referenced from the Rhino model> x2]))

# ----
# Section properties
height = ValueList({"1,5 cm": .015, "2,0 cm": .02, "2,1 cm": .021, "2,2 cm": .022, "2,5 cm": .025, "3,0 cm": .03}, selected="2,5 cm")
width = ValueList({"3 cm": .03, "4 cm": .04, "5 cm": .05, "5,6cm": .056, "6 cm": .06}, selected="5 cm")
# Curvature Analysis
shear_block_lenght = Slider(0.21, range=0..0.5)

# ----
# 3. 3D Model / Curvature Analysis
# (turn off when starting simulation)
_3d_curvature = ValueList({"Off": 0, "On": 1}, selected="Off")

# ----
# Minimum curvature radius method
# Min out of plane curvature radius (Z)
# Min in plane curvature radius (Y)
list_2 = ValueList({"Out of plane bending (Z)": 0, "In plane bending (Y)": 1}, selected="In plane bending (Y)")
min_out_of_plane_r = Slider(2.83, range=0..10)
min_in_plane_r = Slider(3.83, range=0..20)
list_3 = ValueList({"Custom": 0, "Material/Section": 1}, selected="Material/Section")

# ----
# Material selection
# Select timber class (UNI-EN 338)
value_list = ValueList({"C24": 0, "C30": 1}, selected="C30")

optimization = ValueList({"Off": 0, "Galapagos": 1}, selected="Off")
structural_analysis = ValueList({"Stop": 0, "Static": 1}, selected="Stop")
method = ValueList({"Funicular": 0, "Bending": 1}, selected="Bending")

# ---- group: BENDING
funicular = Panel("0")
dynamic = Panel("1000")
static = Panel("1")
on_off = VariableExpression(S=sim_step, B=method, Expression="If(B=0, 1, S)")
filter = StreamFilter(
    Gate=on_off,
    Stream0=funicular,
    Stream1=funicular,
    Stream2=dynamic,
    Stream3=static,
    Stream4=static,
    Stream5=static,
    Stream6=static)

# ----
curvepull = Slider(8000, range=0..8000)
rod_springs_reduction = Slider(0.0015, range=0..0.0015)

plaw_strength_02 = Slider(0, range=-210..3000)
plaw_strength_02_2 = Slider(0, range=-10..3000)
plaw_strength_03 = Slider(0, range=-10..3000)
plaw_strength_04 = Slider(0, range=-10..3000)
entwine = Entwine(
    Branch00=plaw_strength_02,
    Branch01=plaw_strength_02_2,
    Branch02=plaw_strength_03,
    Branch03=plaw_strength_04,
    FlattenInputs=True)

vertical_push = Slider(8.6, range=0..20)
vertical_push_2 = Slider(0, range=-20..50)
vertical_push_3 = Slider(0, range=0..20)
arches_push = Slider(0, range=0..50)

# ----
# Section properties
rod_height = Number(height)
rod_width = Number(width)
vec = VectorXYZ(XComponent=0, YComponent=0, ZComponent=0)  # -> Vector, Length
vec_2 = VectorXYZ(XComponent=rod_width, YComponent=rod_height, ZComponent=0)  # -> Vector, Length
rec_2pt = Rectangle2Pt(Plane=PlaneXY(0, 0, 0), PointA=vec.Vector, PointB=vec_2.Vector, Radius=0)  # -> Rectangle, Length

# ----
# Shear Block section properties
rod_height_2 = Number(height)
rod_width_2 = Number(width)
vec_3 = VectorXYZ(XComponent=rod_width_2, YComponent=expr("x*2", rod_height_2), ZComponent=0)  # -> Vector, Length
vec_4 = VectorXYZ(XComponent=0, YComponent=0, ZComponent=0)  # -> Vector, Length
rec_2pt_2 = Rectangle2Pt(Plane=PlaneXY(0, 0, 0), PointA=vec_4.Vector, PointB=vec_3.Vector, Radius=0)  # -> Rectangle, Length

# ---- group: Curvature radius from section and material properties
panel = Panel("24")
panel_2 = Panel("30")

in_out_of_plane = Data(list_2)
material = Data(value_list)
height_2 = Number(height)
width_2 = Number(width)
filter_2 = StreamFilter(Gate=material, Stream0=panel, Stream1=panel_2)
filter_3 = StreamFilter(Gate=material, Stream0="7400", Stream1="8000")
filter_4 = StreamFilter(Gate=in_out_of_plane, Stream0=height_2, Stream1=width_2)
expression = Expression(fyk=filter_2, E=filter_3, h=filter_4, Expression="1/((2*fyk)/(E*(h*1000)))")
in_out_of_plane_2 = Data(list_2)
custom_out_of_plane_min_r = Data(min_out_of_plane_r)
custom_in_plane_min_r = Data(min_in_plane_r)
division = Division(A=expression, B="1000")
custom_material = Data(list_3)
filter_5 = StreamFilter(Gate=in_out_of_plane_2, Stream0=custom_out_of_plane_min_r, Stream1=custom_in_plane_min_r)
roundd = RoundToDecimalPlace(NumberX=division, DecimalPlace="2", RoundType=0)  # -> Rounded, Difference
panel_3 = Panel(roundd.Rounded)
filter_6 = StreamFilter(Gate=custom_material, Stream0=filter_5, Stream1=roundd.Rounded)
panel_4 = Panel(filter_6)

# ----
# Current min radius (m)
panel_5 = Panel(filter_6)

# ----
# Generate Grid from Grid Maker output
gm_grid = Geometry(grid_maker_grid_trim_geo)
cls = Closed(Curve=gm_grid)  # -> Closed, Periodic
dispatch = Dispatch(List=gm_grid, DispatchPattern=cls.Closed)  # -> ListA, ListB
explode = Explode(Curve=dispatch.ListB, Recursive=True)  # -> flatten(Segments), flatten(Vertices)
area = Area(Geometry=dispatch.ListA)  # -> Area, Centroid
cullpt = CullDuplicates(Points=explode.Vertices, Tolerance=0.1, CullMode=1)  # -> Points, Indices, Valence
cp = ClosestPoint(Point=area.Centroid, Cloud=cullpt.Points)  # -> ClosestPoint, CPIndex, Distance
item = ListItem(List=cullpt.Points, Index=cp.CPIndex, Wrap=True)  # -> Item, Item1
vec2pt = Vector2Pt(PointA=item.Item, PointB=item.Item1, Unitize=False)  # -> Vector, Length
X = UnitX(Factor=item.Item)
shift = ShiftList(List=cullpt.Points, Shift=1, Wrap=True)
rotate_vector = CSharpScript(V=vec2pt.Vector)  # -> Q1; inputs V: Vector3d
# ---------- rotate_vector: C# ----------
// Grasshopper Script Instance
#region Usings
using System;
using System.Linq;
using System.Collections;
using System.Collections.Generic;
using System.Drawing;

using Rhino;
using Rhino.Geometry;

using Grasshopper;
using Grasshopper.Kernel;
using Grasshopper.Kernel.Data;
using Grasshopper.Kernel.Types;
#endregion

public class Script_Instance : GH_ScriptInstance
{
    #region Notes
    /* 
      Members:
        RhinoDoc RhinoDocument
        GH_Document GrasshopperDocument
        IGH_Component Component
        int Iteration

      Methods (Virtual & overridable):
        Print(string text)
        Print(string format, params object[] args)
        Reflect(object obj)
        Reflect(object obj, string method_name)
    */
    #endregion

  private void RunScript(Vector3d V, ref object Q1)
{
  // zero vector → restituisci com’è
  if (V.IsTiny(1e-12)) { Q1 = V; return; }

  double x = V.X, y = V.Y, z = V.Z;
  double xp, yp;

  if (x >= 0 && y >= 0)       { xp = x;   yp = y;   } // QI: nessuna rotazione
  else if (x < 0 && y >= 0)   { xp = y;   yp = -x;  } // QII: ruota -90°  → (y, -x)
  else if (x < 0 && y < 0)    { xp = -x;  yp = -y;  } // QIII: ruota 180° → (-x, -y)
  else /* x >= 0 && y < 0 */  { xp = -y;  yp = x;   } // QIV: ruota +90°  → (-y, x)

  Q1 = new Vector3d(xp, yp, z);
}

}
# ---------- end rotate_vector ----------
auto_grid_dimension = Distance(PointA=cullpt.Points, PointB=shift)
angle_2 = Angle(VectorA=X, VectorB=rotate_vector)  # -> Angle, Reflex
obtain_mode = CSharpScript(N=auto_grid_dimension)  # -> Mode, Count; inputs N: list of Double
# ---------- obtain_mode: C# ----------
// Grasshopper Script Instance
#region Usings
using System;
using System.Linq;
using System.Collections;
using System.Collections.Generic;
using System.Drawing;

using Rhino;
using Rhino.Geometry;

using Grasshopper;
using Grasshopper.Kernel;
using Grasshopper.Kernel.Data;
using Grasshopper.Kernel.Types;
#endregion

public class Script_Instance : GH_ScriptInstance
{
    #region Notes
    /* 
      Members:
        RhinoDoc RhinoDocument
        GH_Document GrasshopperDocument
        IGH_Component Component
        int Iteration

      Methods (Virtual & overridable):
        Print(string text)
        Print(string format, params object[] args)
        Reflect(object obj)
        Reflect(object obj, string method_name)
    */
    #endregion

    private void RunScript(List<double> N, ref object Mode, ref object Count)
{
    if (N == null || N.Count == 0)
    {
        Mode = double.NaN;
        Count = 0;
        return;
    }

    // Use LINQ to group values and count frequencies
    var grouped = N.GroupBy(x => x)
                   .Select(g => new { Value = g.Key, Count = g.Count() })
                   .OrderByDescending(g => g.Count)
                   .ThenBy(g => g.Value) // tie-break: smallest value
                   .ToList();

    var best = grouped.First();

    Mode = best.Value;
    Count = best.Count;
}
}
# ---------- end obtain_mode ----------
deg = Degrees(Radians=angle_2.Angle)  # -> flatten(Degrees)
custom_trim_geometry_2 = Curve(custom_trim_geometry)
gm_grid_center_pt = Point(flatten(cp.ClosestPoint))
custom_grid_maker = Data(list)
custom_rotate_grid = Number(angle)
gm_trim_geo = Geometry(flatten(dispatch.ListA))
gm_grid_dimension = Panel(obtain_mode.Mode)
gm_grid_rotation = Panel(deg)
trim_geo = StreamFilter(Gate=custom_grid_maker, Stream0=custom_trim_geometry_2, Stream1=gm_trim_geo)
grid_rotation = StreamFilter(Gate=custom_grid_maker, Stream0=custom_rotate_grid, Stream1=gm_grid_rotation)
grid_dimension_2 = StreamFilter(Gate=custom_grid_maker, Stream0=grid_dimension, Stream1=gm_grid_dimension)

# ----
# Bounding box for auto count
trim_geometry = Curve(trim_geo)
area_2 = Area(Geometry=trim_geometry)  # -> Area, Centroid
scale = Scale(Geometry=trim_geometry, Center=area_2.Centroid, Factor=Slider(1.5, range=1..2))  # -> Geometry, Transform
brec = BoundingRectangle(Geometry=scale.Geometry, Plane=PlaneXY(0, 0, 0), Axis=0, Slide=0, Union=True)  # -> Bounding, DimensionX, DimensionY
sort = SortList(Keys=[brec.DimensionX, brec.DimensionY])  # -> Keys, ValuesA
item_2 = ListItem(List=sort.Keys, Index=0, Wrap=True)  # -> Item1, Item

# ----
# Move custom center point
trim_geo_center = Point(area_2.Centroid)
t_vector = Vector(move_center_point)
move = Move(Geometry=trim_geo_center, Motion=t_vector)  # -> Geometry, Transform
custom_center_point = Point(move.Geometry)

# ----
# Bounding rectangle
grid_dimension_3 = Number(grid_dimension_2)
brec_l = Number(item_2.Item1)
grid_count = Division(A=brec_l, B=grid_dimension_3)

# ----
# Round to even number
division_2 = Division(A=grid_count, B=2)
int = Integer(division_2)
multiplication = Multiplication(A=int, B=2)

custom_center_point_2 = Point(custom_center_point)
center_pt = StreamFilter(Gate=custom_grid_maker, Stream0=custom_center_point_2, Stream1=gm_grid_center_pt)

# ----
# Generate Grid
series_count = Integer(multiplication)
series = Series(Start=0, Step=grid_dimension_2, Count=series_count)
series_2 = Series(Start=0, Step=grid_dimension_2, Count=series_count)
pt = ConstructPoint(XCoordinate=0, YCoordinate=series, ZCoordinate=0)
pt_2 = ConstructPoint(XCoordinate=series_2, YCoordinate=0, ZCoordinate=0)
pline = PolyLine(Vertices=pt, Closed=False)
X_2 = UnitX(Factor=grid_dimension_2)
pline_2 = PolyLine(Vertices=pt_2, Closed=False)
Y = UnitY(Factor=grid_dimension_2)
arrlinear = LinearArray(Geometry=pline, Direction=X_2, Count=series_count)  # -> flatten(Geometry), Transform
arrlinear_2 = LinearArray(Geometry=pline_2, Direction=Y, Count=series_count)  # -> flatten(Geometry), Transform
path_mapper = PathMapper(arrlinear.Geometry, source="{A}", target="{2}")
path_mapper_2 = PathMapper(arrlinear_2.Geometry, source="{A}", target="{1}")
multiplication_2 = Multiplication(A=grid_dimension_2, B=series_count)
multiplication_3 = Multiplication(A=grid_dimension_2, B=series_count)
pt_3 = ConstructPoint(XCoordinate=expr("x/2", multiplication_2), YCoordinate=expr("x/2", multiplication_3), ZCoordinate=0)
grid_center_point = Point(center_pt)
crv = Curve([path_mapper_2, path_mapper])
grid_center_point_2 = Point(center_pt)
orient = Orient(Geometry=crv, Source=pt_3, Target=grid_center_point)  # -> Geometry, Transform
angle_3 = Number(grid_rotation)
rotate = Rotate(Geometry=orient.Geometry, Angle=degrees(angle_3), Plane=grid_center_point_2)  # -> Geometry, Transform
bang = ExplodeTree(Data=rotate.Geometry)  # -> Branch0, Branch1

# ----
# Input geometries
grid = Curve([bang.Branch0, bang.Branch1])

# ----
# Trim grid
trim_geometry_2 = Curve(trim_geo)
bang_2 = ExplodeTree(Data=grid)  # -> Branch0, Branch1
boundary = BoundarySurfaces(Edges=trim_geometry_2)
project = Project(Curve=bang_2.Branch1, Brep=boundary, Direction=Vector(0, 0, 1))  # -> flatten(Curve)
project_2 = Project(Curve=bang_2.Branch0, Brep=boundary, Direction=Vector(0, 0, 1))  # -> flatten(Curve)
clean = CleanTree(RemoveNulls=True, RemoveInvalid=True, RemoveEmpty=True, Tree=project_2)
clean_2 = CleanTree(RemoveNulls=True, RemoveInvalid=True, RemoveEmpty=True, Tree=project)
path_mapper_3 = PathMapper(clean, source="{A}", target="{1}")
path_mapper_4 = PathMapper(clean_2, source="{A}", target="{2}")
crv_x = Curve(path_mapper_3)
crv_y = Curve(path_mapper_4)
number_slider = Slider(0.01, range=0..0.1)
explode_2 = Explode(Curve=crv_x, Recursive=True)  # -> Segments, Vertices
explode_3 = Explode(Curve=crv_y, Recursive=True)  # -> Segments, Vertices
len = Length(Curve=explode_2.Segments)
len_2 = Length(Curve=explode_3.Segments)
smaller = SmallerThan(FirstNumber=len, SecondNumber=number_slider)  # -> SmallerThan, OrEqualTo
smaller_2 = SmallerThan(FirstNumber=len_2, SecondNumber=number_slider)  # -> SmallerThan, OrEqualTo
dispatch_2 = Dispatch(List=explode_2.Segments, DispatchPattern=smaller.SmallerThan)  # -> ListA, ListB
dispatch_3 = Dispatch(List=explode_3.Segments, DispatchPattern=smaller_2.SmallerThan)  # -> ListA, ListB
crv_2 = Curve(dispatch_2.ListB)
crv_3 = Curve(dispatch_3.ListB)

# ----
# Diagonals
y_rods = Geometry(bang_2.Branch1)
explode_4 = Explode(Curve=graft(y_rods), Recursive=True)  # -> Segments, simplify(Vertices)
relative_item = RelativeItem(Tree=reverse(explode_4.Vertices), Offset="{+1} [+1]", WrapPaths=False, WrapItems=False)  # -> ItemA, ItemB
relative_item_2 = RelativeItem(Tree=explode_4.Vertices, Offset="{+1} [+1]", WrapPaths=False, WrapItems=False)  # -> ItemA, ItemB
line = Line(StartPoint=relative_item.ItemA, EndPoint=relative_item.ItemB)
line_2 = Line(StartPoint=relative_item_2.ItemA, EndPoint=relative_item_2.ItemB)
diagonals = Diagonals(T=line_2)
diagonals_2 = Diagonals(T=line)

# ----
# Trim diagonals
trim_boundary_surface = BoundarySurfaces(Edges=trim_geometry_2)
project_3 = Project(Curve=diagonals, Brep=trim_boundary_surface, Direction=Vector(0, 0, 1))  # -> flatten(Curve)
project_4 = Project(Curve=diagonals_2, Brep=trim_boundary_surface, Direction=Vector(0, 0, 1))  # -> flatten(Curve)
clean_3 = CleanTree(RemoveNulls=True, RemoveInvalid=True, RemoveEmpty=True, Tree=project_3)
clean_4 = CleanTree(RemoveNulls=True, RemoveInvalid=True, RemoveEmpty=True, Tree=project_4)
path_mapper_5 = PathMapper(clean_4, source="{A}", target="{4}")
path_mapper_6 = PathMapper(clean_3, source="{A}", target="{3}")
diagonal = Curve([path_mapper_6, path_mapper_5])
explode_5 = Explode(Curve=diagonal, Recursive=True)  # -> Segments, Vertices
panel_6 = Panel("""-1
0""")
cull_i = CullIndex(List=explode_5.Segments, Indices=panel_6, Wrap=True)
len_3 = Length(Curve=cull_i)
smaller_3 = SmallerThan(FirstNumber=len_3, SecondNumber=Slider(0.05, range=0..0.1))  # -> SmallerThan, OrEqualTo
dispatch_4 = Dispatch(List=cull_i, DispatchPattern=smaller_3.SmallerThan)  # -> ListA, ListB

cullpt_2 = CullDuplicates(Points=flatten([explode_2.Vertices, explode_3.Vertices]), Tolerance=0.001, CullMode=3)  # -> Points, Indices, Valence

# ----
# Geometries
plane_grid_points = Point(cullpt_2.Points)
shear_block = Point()
diagonal_2 = Curve(dispatch_4.ListB)
x_rods = Line(crv_2)
y_rods_2 = Line(crv_3)

# ---- group: GROUND POINTS
# Kangaroo Simulation
# Select ground points
grid_pts = Point(plane_grid_points)
cullpt_3 = CullDuplicates(Points=grid_pts, Tolerance=0.0001, CullMode=1)  # -> Points, Indices, Valence
path_mapper_7 = PathMapper(cullpt_3.Points, source="{A;B;C}", target="{5;a}")
incurves = PointInCurves(Point=path_mapper_7, Curves=curve_for_ground_points_selection)  # -> Relationship, Index, Point
expression_2 = Expression(x=incurves.Relationship, Expression="if(x=2, true, false)")
cull = CullPattern(List=path_mapper_7, CullPattern=expression_2)
ground_points = Data(cull)

# ---- group: SPRINGS
width_x_height = Multiplication(A=width, B=height)
e_larice = Panel("10600")
e_elastic_modulus = Data(e_larice)
screw_length = Data(grid_dimension_2)
section_screw_area = Data(width_x_height)
_2a_e_l_kn_m = VariableExpression(A=section_screw_area, E=e_elastic_modulus, L=screw_length, Expression="(((2*A)*E*1000)/(L))")

# ----
grid_xy = Data([x_rods, y_rods_2])
griglia = Line(grid_xy)
join = JoinCurves(Curves=griglia, Preserve=False)
explode_6 = Explode(Curve=join, Recursive=True)  # -> Segments, Vertices
bendstrength = Data(filter)
pline_3 = PolyLine(Vertices=explode_6.Vertices, Closed=False)
multiplication_4 = Multiplication(A=bendstrength, B=Slider(1, range=0..100))
polylinebend = PolyLineBend(polyline=pline_3, bendstrength=multiplication_4, B=Slider(0, range=0..100))  # -> L, B_2
bend = Data(polylinebend.B_2)

plane_grid_1_0_points = Point(plane_grid_points)
Z = UnitZ(Factor=0)
Z_2 = UnitZ(Factor=Slider(100, range=0..100))
filter_7 = StreamFilter(Gate=pull_up, Stream0=Z_2, Stream1=Z)
uforce = UnaryForce(Point=plane_grid_1_0_points, Force=filter_7)
gravity = Data(uforce)

diagonal_3 = Curve(diagonal_2)
springsfromline = SpringsFromLine(
    Connection=diagonal_3,
    Stiffness=Slider(20, range=0..100),
    Damping=10,
    RestLength=0,
    UpperCutoff=0,
    LowerCutoff=0,
    Plasticity=0)

in_out_of_plane_3 = Data(list_2)
minimum_curvature_r = Data(filter_6)

# ---- group: CURVE PULL
bang_3 = ExplodeTree(Data=ground_points)  # -> Branch0, Branch1, Branch2, Branch3, Branch4, Branch5, Branch6, Branch7
ground_points_2 = Entwine(
    Branch00=bang_3.Branch0,
    Branch01=bang_3.Branch1,
    Branch02=bang_3.Branch2,
    Branch03=bang_3.Branch3,
    Branch04=bang_3.Branch4,
    Branch05=bang_3.Branch5,
    Branch06=bang_3.Branch6,
    Branch07=bang_3.Branch7,
    FlattenInputs=True)
funicular_2 = Slider(1252, range=0..5000)
sim_tight = Panel(curvepull)
panel_7 = Panel("Curve Pull")
on_off_2 = VariableExpression(S=sim_step, B=method, Expression="If(B=0, 1, S)")
join_2 = JoinCurves(Curves=curve_constrain, Preserve=False)

# ---- group: POWER LAW
inter = InterconnectPoints(Pts=ground_points_2)
strength = Strength(entwine)
expression_3 = Expression(x=method, a=strength, Expression="If(x=1, a, 1)")
clean_5 = CleanTree(Data=inter, CleanInvalid=True, CleanEmpty=False)
plaw = PowerLaw(Connection=clean_5, Exponents=0, Strength=expression_3, Cutoff="1")
power_law = Data(plaw)

# ---- group: SPRINGS
grid_xy_2 = Data([x_rods, y_rods_2])
panel_8 = Panel(_2a_e_l_kn_m)

# ----
# Kangaroo Inputs
len_4 = Length(Curve=grid_xy_2)
curve_constrain_2 = Curve(join_2)

# ---- group: SPRINGS (continued)
rod_springs = SpringsFromLine(Connection=grid_xy_2, StiffnessKNM=panel_8, Damping=1, RestLength=len_4, UpperCutoff=0, LowerCutoff=0, Plasticity=0)
lath_springs = Data(rod_springs)

# ----
# Kangaroo Inputs
grid_springs = Data([lath_springs, springsfromline])
power_law_2 = Data(power_law)
bend_2 = Data(bend)
gravity_2 = Data(gravity)

grid_xy_3 = Data([x_rods, y_rods_2])
len_5 = Length(Curve=grid_xy_3)

# ----
# Kangaroo
# Kangaroo settings
simreset = VariableExpression(step=sim_step, Expression="If(step=0, true, false)")
counter = Counter(Reset=simreset)
expression_4 = Expression(x=counter, Expression="If(x<50, x/10, 10)")
filter_8 = StreamFilter(Gate=optimization, Stream0=simreset)
kangaroo_geo = Geometry(simplify([y_rods_2, x_rods, diagonal_2, ground_points]))
filter_9 = StreamFilter(Gate=optimization, Stream0="500", Stream1="15000")
kangaroo_settings = KangarooSettings(
    Tolerance=0.0001,
    TimeStep=0.001,
    SubIterations=filter_9,
    Floor=True,
    Drag=20,
    Restitution=0,
    StaticFriction=0.1,
    KineticFriction=0.1,
    Settle=expression_4,
    Tumble=1,
    Sound=False,
    Solver=0)

# ---- group: CURVE PULL (continued)
expression_5 = Expression(x=counter, Expression="10+(x*35)")
exp = VariableExpression(a=expression_5, b=funicular_2, Expression="If(a<b, a+0.1, b)")
exp_2 = VariableExpression(a=expression_5, b=sim_tight, Expression="If(a<(b-(b*0.2)), a+0.1, (b-(b*0.2)))")
curve_pull_strength = StreamFilter(
    Gate=on_off_2,
    Stream0="1",
    Stream1=exp,
    Stream2=exp_2,
    Stream3=sim_tight,
    Stream4=sim_tight,
    Stream5=sim_tight,
    Stream6=sim_tight)
curve_pull_strength_2 = Data(curve_pull_strength)
expression_6 = Expression(x=method, a=curve_pull_strength_2, Expression="If(x=1, a, 0)")
curvepull_2 = CurvePull(Curve=curve_constrain_2, Points=ground_points_2, Strength=expression_6)
curve_pull = Data(curvepull_2)

# ----
ground_forces = Data(curve_pull)

force_objects = Data([ground_forces, grid_springs, bend_2, power_law_2, gravity_2])
null = NullItem(Item=force_objects)  # -> NullFlags, InvalidFlags, Description
not = GateNot(A=null.NullFlags)
cull_2 = CullPattern(List=force_objects, CullPattern=not)
force_objects_2 = Data(flatten(cull_2))

kangaroo = KangarooPhysics(ForceObjects=flatten(force_objects_2), Settings=kangaroo_settings, Geometry=kangaroo_geo, SimulationReset=filter_8)  # -> Out, Iterations, ParticlesOut, GeometryOut, KE

# ---- group: HEIGHT extracting
pdecon = Deconstruct(Point=kangaroo.ParticlesOut)  # -> XComponent, YComponent, ZComponent
sort_2 = SortList(Keys=pdecon.ZComponent, ValuesA=pdecon.ZComponent)  # -> Keys, reverse(ValuesA)
item_3 = ListItem(List=sort_2.ValuesA, Index=0, Wrap=True)

# ---- group: 2D Visualization during simulation
# 3D model
data = Data(_3d_curvature)
gate = StreamGate(Stream=kangaroo.GeometryOut, Gate=data)  # -> Target0, Target1, Target2
_2d_visualization = Geometry(gate.Target0)

# ----
# Data cleaning
optimization_on_off = Data(optimization)
geo_out_kangaroo = Data(gate.Target1)
grid_xy_4 = Line(simplify([y_rods_2, x_rods, diagonal_2]))
lng = ListLength(List=grid_xy_4)
split = SplitList(List=geo_out_kangaroo, Index=lng)  # -> ListA, ListB
filter_10 = StreamFilter(Gate=optimization_on_off, Stream0=geo_out_kangaroo, Stream1=split.ListB)
data_2 = Data(filter_10)
tstat = TreeStatistics(Tree=data_2)  # -> Paths, Length, Count
substr = SubString(String=tstat.Paths, Start=1, Count=1)
int_2 = Integer(substr)

_1_a = VariableExpression(S=int_2, Expression="If(S=1, true, false)")
dispatch_5 = Dispatch(List=tstat.Paths, DispatchPattern=_1_a)  # -> ListA, ListB
branch = TreeBranch(Tree=data_2, Path=dispatch_5.ListA, MaintainPaths=False)

_2_a = VariableExpression(S=int_2, Expression="If(S=2, true, false)")
dispatch_6 = Dispatch(List=tstat.Paths, DispatchPattern=_2_a)  # -> ListA, ListB
branch_2 = TreeBranch(Tree=data_2, Path=dispatch_6.ListA, MaintainPaths=False)

_3_a = VariableExpression(S=int_2, Expression="If(S=3, true, false)")
dispatch_7 = Dispatch(List=tstat.Paths, DispatchPattern=_3_a)  # -> ListA, ListB
branch_3 = TreeBranch(Tree=data_2, Path=dispatch_7.ListA, MaintainPaths=False)

_4_a = VariableExpression(S=int_2, Expression="If(S=4, true, false)")
dispatch_8 = Dispatch(List=tstat.Paths, DispatchPattern=_4_a)  # -> ListA, ListB
branch_4 = TreeBranch(Tree=data_2, Path=dispatch_8.ListA, MaintainPaths=False)

_5_a = VariableExpression(S=int_2, Expression="If(S=5, true, false)")
dispatch_9 = Dispatch(List=tstat.Paths, DispatchPattern=_5_a)  # -> ListA, ListB
branch_5 = TreeBranch(Tree=data_2, Path=dispatch_9.ListA, MaintainPaths=False)

path_mapper_8 = PathMapper(branch_4, source="{A}", target="{4;A}")
path_mapper_9 = PathMapper(branch_3, source="{A}", target="{3;A}")
path_mapper_10 = PathMapper(branch, source="{A}", target="{1;A}")
path_mapper_11 = PathMapper(branch_2, source="{A}", target="{2;A}")
path_mapper_12 = PathMapper(branch_5, source="{A}", target="{5;A}")
wood_diagonals_y = Data(path_mapper_8)
wood_diagonals_x = Data(path_mapper_9)
ground_points_3 = Geometry(path_mapper_12)
x_rods_2 = Data(path_mapper_10)
y_rods_3 = Data(path_mapper_11)

data_3 = Data([x_rods_2, y_rods_3])
len_6 = Length(Curve=data_3)
subtraction = Subtraction(A=len_6, B=len_5)
sort_3 = SortList(Keys=flatten(subtraction))  # -> Keys, ValuesA
avr = Average(Input=flatten(subtraction))
item_4 = ListItem(List=sort_3.Keys, Index=0, Wrap=True)
panel_9 = Panel(avr)

iterations = Panel(kangaroo.Iterations)
max_n_extension = Panel(item_4)
h_max = Panel(item_3)

# ----
# Patch surface
end = EndPoints(Curve=flatten([x_rods_2, y_rods_3]))  # -> Start, End
cullpt_4 = CullDuplicates(Points=[end.Start, end.End], Tolerance=Slider(0.001, range=0..0.001), CullMode=1)  # -> Points, Indices, Valence
patch = Patch(Points=flatten(cullpt_4.Points), Spans=20, Flexibility=Slider(5, range=0..100), Trim=True)

# ----
# Shear Block Pts Y
segments = Geometry(y_rods_3)
grid_dimension_4 = Number(grid_dimension_2)
roundd_2 = RoundToDecimalPlace(NumberX=segments, DecimalPlace="2", RoundType=0)  # -> Rounded, Difference
equals = Equality(FirstNumber=roundd_2.Rounded, SecondNumber=grid_dimension_4)  # -> Equality, Inequality
shear_block_lenght_2 = Number(shear_block_lenght)
dispatch_10 = Dispatch(List=segments, DispatchPattern=equals.Equality)  # -> ListA, ListB
neg = Negative(Value=shear_block_lenght_2)
midpt = CurveMiddle(Curve=dispatch_10.ListA)
amp = Amplitude(Vector=dispatch_10.ListA, Amplitude=shear_block_lenght_2)
amp_2 = Amplitude(Vector=dispatch_10.ListA, Amplitude=neg)
move_2 = Move(Geometry=midpt, Motion=expr("X/2", amp_2))  # -> Geometry, Transform
move_3 = Move(Geometry=midpt, Motion=expr("X/2", amp))  # -> Geometry, Transform
join_3 = JoinCurves(Curves=dispatch_10.ListA, Preserve=False)
merge = Merge(Data1=move_3.Geometry, Data2=move_2.Geometry)
alongcrv = SortAlongCurve(Points=merge, Curve=join_3)  # -> Points, Indices
partition = PartitionList(List=alongcrv.Points, Size="2")

# ----
# Shear Block Pts X
segments_2 = Geometry(x_rods_2)
grid_dimension_5 = Number(grid_dimension_2)
roundd_3 = RoundToDecimalPlace(NumberX=segments_2, DecimalPlace="2", RoundType=0)  # -> Rounded, Difference
equals_2 = Equality(FirstNumber=roundd_3.Rounded, SecondNumber=grid_dimension_5)  # -> Equality, Inequality
shear_block_lenght_3 = Number(shear_block_lenght)
dispatch_11 = Dispatch(List=segments_2, DispatchPattern=equals_2.Equality)  # -> ListA, ListB
neg_2 = Negative(Value=shear_block_lenght_3)
midpt_2 = CurveMiddle(Curve=dispatch_11.ListA)
amp_3 = Amplitude(Vector=dispatch_11.ListA, Amplitude=shear_block_lenght_3)
amp_4 = Amplitude(Vector=dispatch_11.ListA, Amplitude=neg_2)
move_4 = Move(Geometry=midpt_2, Motion=expr("X/2", amp_4))  # -> Geometry, Transform
move_5 = Move(Geometry=midpt_2, Motion=expr("X/2", amp_3))  # -> Geometry, Transform
join_4 = JoinCurves(Curves=dispatch_11.ListA, Preserve=False)
merge_2 = Merge(Data1=move_5.Geometry, Data2=move_4.Geometry)
alongcrv_2 = SortAlongCurve(Points=merge_2, Curve=join_4)  # -> Points, Indices
partition_2 = PartitionList(List=alongcrv_2.Points, Size="2")

x_rods_3 = Data(x_rods_2)
y_rods_4 = Data(y_rods_3)
item_5 = ListItem(List=[x_rods_3, y_rods_4], Index=0, Wrap=True)  # -> Item2, Item1, Item
preview = CustomPreview(Geometry=[item_5.Item, item_5.Item1], Material=ColourSwatch(SwatchColor=RGBA(150, 150, 150, 116)))

wood_diagonals_y_2 = Data(path_mapper_8)
wood_diagonals_x_2 = Data(path_mapper_9)
x_rods_4 = Data(x_rods_2)
y_rods_5 = Data(path_mapper_11)
merge_3 = Merge(Data1=x_rods_4, Data2=y_rods_5, Data3=wood_diagonals_x_2, Data4=wood_diagonals_y_2)

wood_diagonals_y_3 = Data(path_mapper_8)
wood_diagonals_x_3 = Data(path_mapper_9)
# Curvature Analysis
x_rods_5 = Data(x_rods_2)
y_rods_6 = Data(path_mapper_11)
merge_4 = Merge(Data1=x_rods_5, Data2=y_rods_6, Data3=wood_diagonals_x_3, Data4=wood_diagonals_y_3)

tstat_2 = TreeStatistics(Tree=merge_3)  # -> Paths, Length, Count
larger = LargerThan(FirstNumber=tstat_2.Length, SecondNumber="1")  # -> LargerThan, OrEqualTo
cull_pattern = CullPattern(List=tstat_2.Paths, CullPattern=larger.LargerThan)  # -> flatten(List)
branch_6 = TreeBranch(Tree=merge_3, Path=cull_pattern, MaintainPaths=True)

# ---- group: Remove Rods with only 1 segment
tstat_3 = TreeStatistics(Tree=merge_4)  # -> Paths, Length, Count
larger_2 = LargerThan(FirstNumber=tstat_3.Length, SecondNumber="1")  # -> LargerThan, OrEqualTo
cull_pattern_2 = CullPattern(List=tstat_3.Paths, CullPattern=larger_2.LargerThan)  # -> flatten(List)
branch_7 = TreeBranch(Tree=merge_4, Path=cull_pattern_2, MaintainPaths=True)

# ----
len_7 = Length(Curve=branch_6)
larger_3 = LargerThan(FirstNumber=len_7, SecondNumber="0.05")  # -> LargerThan, OrEqualTo
dispatch_12 = Dispatch(List=branch_6, DispatchPattern=larger_3.LargerThan)  # -> ListA, ListB

# ---- group: Remove segment smaller than 5 cm
len_8 = Length(Curve=branch_7)
larger_4 = LargerThan(FirstNumber=len_8, SecondNumber="0.05")  # -> LargerThan, OrEqualTo
dispatch_13 = Dispatch(List=branch_7, DispatchPattern=larger_4.LargerThan)  # -> ListA, ListB

# ----
# Gaussian curvature analysis
number_slider_2 = Slider(62, range=0..100)  # disabled
patch_2 = Surface(patch)  # disabled
sdivide = DivideSurface(Surface=patch_2, UCount=number_slider_2, VCount=number_slider_2)  # -> flatten(Points), Normals, flatten(Parameters); disabled
curvature = SurfaceCurvature(Surface=patch_2, Point=sdivide.Parameters)  # -> Frame, Gaussian, Mean; disabled
abs = Absolute(Value=curvature.Gaussian)  # disabled
bnd = Bounds(Numbers=abs)  # disabled
number_slider_3 = Slider(0.004, range=0..0.33)  # disabled
dedomain = DeconstructDomain(Domain=bnd)  # -> Start, End; disabled
gradient = Gradient(
    LowerLimit=dedomain.Start,
    UpperLimit=number_slider_3,
    Parameter=abs,
    stops=[0: RGB(0, 128, 0), 0.5: RGB(255, 255, 0), 1: RGB(255, 0, 0)])  # disabled
preview_2 = CustomPreview(Geometry=sdivide.Points, Material=gradient)  # disabled

# ----
# Genera diagonali
wood_diagonals_x_4 = Data(wood_diagonals_y)
patch_3 = Surface(patch_2)
pts_on_srf = GridPointsOnSurface(curves=wood_diagonals_x_4, S=patch_3)  # -> P, R
orient_along_rod = OrientAlongRod(geometry=rec_2pt.Rectangle, points=pts_on_srf.P, normal_vectors=pts_on_srf.R)

# ----
# Genera diagonali
wood_diagonals_y_4 = Data(wood_diagonals_x)
patch_4 = Surface(patch_2)
pts_on_srf_2 = GridPointsOnSurface(curves=wood_diagonals_y_4, S=patch_4)  # -> P, R
orient_along_rod_2 = OrientAlongRod(geometry=rec_2pt.Rectangle, points=pts_on_srf_2.P, normal_vectors=pts_on_srf_2.R)

# ----
# x rod sections
patch_5 = Surface(patch_2)
x_rods_6 = Data(x_rods_2)
pts_on_srf_3 = GridPointsOnSurface(curves=x_rods_6, S=patch_5)  # -> P, R
orient_along_rod_3 = OrientAlongRod(geometry=rec_2pt.Rectangle, points=pts_on_srf_3.P, normal_vectors=pts_on_srf_3.R)

# ----
# y rod sections
y_rods_7 = Data(y_rods_3)
patch_6 = Surface(patch_2)
pts_on_srf_4 = GridPointsOnSurface(curves=y_rods_7, S=patch_6)  # -> P, R
orient_along_rod_4 = OrientAlongRod(geometry=rec_2pt.Rectangle, points=pts_on_srf_4.P, normal_vectors=pts_on_srf_4.R)

# ----
# Layer 2
y_component_section = Number(height)
multiplication_5 = Multiplication(A=y_component_section, B="3")
n_vectors = UnitVector(Vector=pts_on_srf_3.R)
amp_5 = Amplitude(Vector=n_vectors, Amplitude=multiplication_5)
x_sections = Geometry(orient_along_rod_3)
move_6 = Move(Geometry=x_sections, Motion=expr("-X", amp_5))  # -> Geometry, Transform
loft = Loft(Curves=move_6.Geometry, Options={Adjust=False, Closed=False, LoftEnds=0, LoftSimp=0, LoftType=0, Rebuild=10, Refit=0.01})

x_component_section = Number(height)
multiplication_6 = Multiplication(A=x_component_section, B=Slider(6, range=0..10))
n_vector = Vector(pts_on_srf_2.R)
amp_6 = Amplitude(Vector=n_vector, Amplitude=expr("-x", multiplication_6))
move_7 = Move(Geometry=orient_along_rod_2, Motion=amp_6)  # -> Geometry, Transform
loft_2 = Loft(Curves=move_7.Geometry, Options={Adjust=False, Closed=False, LoftEnds=0, LoftSimp=0, LoftType=0, Rebuild=10, Refit=0.01})

# ----
# Layer 1
y_component_section_2 = Number(height)
n_vectors_2 = UnitVector(Vector=pts_on_srf_4.R)
multiplication_7 = Multiplication(A=y_component_section_2, B="4")
amp_7 = Amplitude(Vector=n_vectors_2, Amplitude=multiplication_7)
y_sections = Geometry(orient_along_rod_4)
move_8 = Move(Geometry=y_sections, Motion=expr("-x", amp_7))  # -> Geometry, Transform
loft_3 = Loft(Curves=move_8.Geometry, Options={Adjust=False, Closed=False, LoftEnds=0, LoftSimp=0, LoftType=0, Rebuild=10, Refit=0.01})

# ----
# 3D Rods
x_component_section_2 = Number(height)
n_vector_2 = Vector(pts_on_srf.R)

multiplication_8 = Multiplication(A=x_component_section_2, B=Slider(5, range=0..10))
amp_8 = Amplitude(Vector=n_vector_2, Amplitude=expr("-x", multiplication_8))
move_9 = Move(Geometry=orient_along_rod, Motion=amp_8)  # -> Geometry, Transform
loft_4 = Loft(Curves=move_9.Geometry, Options={Adjust=False, Closed=False, LoftEnds=0, LoftSimp=0, LoftType=0, Rebuild=10, Refit=0.01})

# ----
# Layer 3
y_component_section_3 = Number(height)
n_vectors_3 = UnitVector(Vector=pts_on_srf_4.R)
multiplication_9 = Multiplication(A=y_component_section_3, B="1")
amp_9 = Amplitude(Vector=n_vectors_3, Amplitude=expr("-x", multiplication_9))
y_sections_2 = Geometry(orient_along_rod_4)
move_10 = Move(Geometry=y_sections_2, Motion=amp_9)  # -> Geometry, Transform
loft_5 = Loft(
    Curves=move_10.Geometry,
    Options={Adjust=False, Closed=False, LoftEnds=0, LoftSimp=0, LoftType=0, Rebuild=10, Refit=0.01})

# ----
# Layer 4
# VISUALIZZAZIONE DURANTE SIMULAZIONE
x_sections_2 = Geometry(orient_along_rod_3)
loft_6 = Loft(Curves=x_sections_2, Options={Adjust=False, Closed=False, LoftEnds=0, LoftSimp=0, LoftType=0, Rebuild=10, Refit=0.01})

_3d_diagonals_y = Geometry(loft_2)
_3d_diagonals_x = Geometry(loft_4)
_3d_rods_y = Geometry([loft_3, loft_5])
_3d_rods_x = Geometry([loft_6, loft])

shear_block_pts = Point(partition_2)
# 3D Shear Blocks
patch_7 = Surface(patch_2)
srf_cp = SurfaceClosestPoint(Point=shear_block_pts, Surface=patch_7)  # -> Point, UVPoint, Distance
Z_3 = UnitZ(Factor=1)  # -> expr("-x", UnitVector)
evalsrf = EvaluateSurface(Surface=patch_7, Point=srf_cp.UVPoint)  # -> Point, Normal, UDirection, VDirection, Frame
dprod = DotProduct(VectorA=evalsrf.Normal, VectorB=Z_3, Unitize=False)
expression_7 = Expression(d=dprod, Expression="if(d < 0, -1, 1)")
multiplication_10 = Multiplication(A=evalsrf.Normal, B=expression_7)

shear_block_pts_2 = Point(partition)
patch_8 = Surface(patch_2)
srf_cp_2 = SurfaceClosestPoint(Point=shear_block_pts_2, Surface=patch_8)  # -> Point, UVPoint, Distance
Z_4 = UnitZ(Factor=1)  # -> expr("-x", UnitVector)
evalsrf_2 = EvaluateSurface(Surface=patch_8, Point=srf_cp_2.UVPoint)  # -> Point, Normal, UDirection, VDirection, Frame
dprod_2 = DotProduct(VectorA=evalsrf_2.Normal, VectorB=Z_4, Unitize=False)
expression_8 = Expression(d=dprod_2, Expression="if(d < 0, -1, 1)")
multiplication_11 = Multiplication(A=evalsrf_2.Normal, B=expression_8)

x_component_section_3 = Number(height)
multiplication_12 = Multiplication(A=x_component_section_3, B=Slider(1.5, range=0..10))
orient_along_rod_5 = OrientAlongRod(geometry=rec_2pt_2.Rectangle, points=evalsrf.Point, normal_vectors=multiplication_10)
n_vector_3 = Vector(multiplication_10)
amp_10 = Amplitude(Vector=n_vector_3, Amplitude=expr("-x", multiplication_12))
move_11 = Move(Geometry=orient_along_rod_5, Motion=amp_10)  # -> simplify(Geometry), Transform
loft_7 = Loft(
    Curves=move_11.Geometry,
    Options={Adjust=False, Closed=False, LoftEnds=0, LoftSimp=0, LoftType=0, Rebuild=10, Refit=0.01})

x_component_section_4 = Number(height)
multiplication_13 = Multiplication(A=x_component_section_4, B=Slider(2.5, range=0..10))
orient_along_rod_6 = OrientAlongRod(geometry=rec_2pt_2.Rectangle, points=evalsrf_2.Point, normal_vectors=multiplication_11)
n_vector_4 = Vector(multiplication_11)
amp_11 = Amplitude(Vector=n_vector_4, Amplitude=expr("-x", multiplication_13))
move_12 = Move(Geometry=orient_along_rod_6, Motion=amp_11)  # -> simplify(Geometry), Transform
loft_8 = Loft(
    Curves=move_12.Geometry,
    Options={Adjust=False, Closed=False, LoftEnds=0, LoftSimp=0, LoftType=0, Rebuild=10, Refit=0.01})

main_grid_x_3d_xrods = CustomPreview(Geometry=[_3d_rods_x, loft_7], Material=ColourSwatch(SwatchColor=RGB(204, 84, 73)))
main_grid_y_3d_rods = CustomPreview(Geometry=[_3d_rods_y, loft_8], Material=ColourSwatch(SwatchColor=RGB(255, 200, 117)))
diagonal_x_3d_rods = CustomPreview(Geometry=_3d_diagonals_x, Material=ColourSwatch(SwatchColor=RGB(113, 168, 88)))
diagonal_y_3d_rods = CustomPreview(Geometry=_3d_diagonals_y, Material=ColourSwatch(SwatchColor=RGB(48, 112, 245)))

patch_from_pts = Surface(patch_2)
midpt_3 = CurveMiddle(Curve=dispatch_12.ListA)
srf_cp_3 = SurfaceClosestPoint(Point=midpt_3, Surface=patch_from_pts)  # -> Point, UVPoint, Distance
xy_diagonals = Geometry(dispatch_12.ListA)
evalsrf_3 = EvaluateSurface(Surface=patch_from_pts, Point=srf_cp_3.UVPoint)  # -> Point, Normal, UDirection, VDirection, Frame
pl = ConstructPlane(Origin=evalsrf_3.Point, XAxis=xy_diagonals, YAxis=expr("-x", evalsrf_3.Normal))
rot3d = Rotate3D(Geometry=pl, Angle=degrees("90"), Center=evalsrf_3.Point, Axis=xy_diagonals)  # -> Geometry, Transform
shift_2 = ShiftList(List=rot3d.Geometry, Shift=1, Wrap=invert(True))
short = ShortestList(ListA=dispatch_12.ListA, ListB=shift_2, TrimMode=2)  # -> ListA, ListB
shift_3 = ShiftList(List=dispatch_12.ListA, Shift=1, Wrap=invert(True))  # -> graft(List)
project_5 = Project(Geometry=short.ListA, Plane=short.ListB)  # -> graft(Geometry), Transform

patch_from_pts_2 = Surface(patch_2)
midpt_4 = CurveMiddle(Curve=dispatch_13.ListA)
srf_cp_4 = SurfaceClosestPoint(Point=midpt_4, Surface=patch_from_pts_2)  # -> Point, UVPoint, Distance
evalsrf_4 = EvaluateSurface(Surface=patch_from_pts_2, Point=srf_cp_4.UVPoint)  # -> Point, Normal, UDirection, VDirection, Frame
xy_diagonals_2 = Geometry(dispatch_13.ListA)
pl_2 = ConstructPlane(Origin=evalsrf_4.Point, XAxis=evalsrf_4.Normal, YAxis=xy_diagonals_2)
remove_first_plane = ShiftList(List=pl_2, Shift=1, Wrap=invert(True))
remove_last_segment = ShortestList(ListA=dispatch_13.ListA, ListB=remove_first_plane, TrimMode=2)  # -> ListA, ListB
remove_first_segment = ShiftList(List=dispatch_13.ListA, Shift=1, Wrap=invert(True))  # -> graft(List)
project_segment_on_next_plane = Project(Geometry=remove_last_segment.ListA, Plane=remove_last_segment.ListB)  # -> graft(Geometry), Transform

end_2 = EndPoints(Curve=remove_first_segment)  # -> Start, End
end_3 = EndPoints(Curve=project_segment_on_next_plane.Geometry)  # -> Start, End
move2pt = MoveToPoint(Geometry=project_segment_on_next_plane.Geometry, PointA=end_3.End, PointB=end_2.Start)  # -> Moved, Vector, Transform
join_5 = JoinCurves(Curves=[remove_first_segment, move2pt.Moved], Preserve=False)
explode_7 = Explode(Curve=join_5, Recursive=True)  # -> Segments, Vertices
item_6 = ListItem(List=explode_7.Vertices, Index=0, Wrap=True)  # -> Item, Item1
intcrv = Interpolate(Vertices=explode_7.Vertices, Degree=3, Periodic=False, KnotStyle=1)  # -> Curve, Length, Domain

end_4 = EndPoints(Curve=project_5.Geometry)  # -> Start, End
end_5 = EndPoints(Curve=shift_3)  # -> Start, End
move2pt_2 = MoveToPoint(Geometry=project_5.Geometry, PointA=end_4.End, PointB=end_5.Start)  # -> Moved, Vector, Transform
join_6 = JoinCurves(Curves=[shift_3, move2pt_2.Moved], Preserve=False)
explode_8 = Explode(Curve=join_6, Recursive=True)  # -> Segments, Vertices
item_7 = ListItem(List=explode_8.Vertices, Index=0, Wrap=True)  # -> Item, Item1
intcrv_2 = Interpolate(Vertices=explode_8.Vertices, Degree=3, Periodic=False, KnotStyle=1)  # -> Curve, Length, Domain

pt_4 = Point(item_6.Item1)
crv_cp = CurveClosestPoint(Point=pt_4, Curve=intcrv.Curve)  # -> Point, Parameter, Distance
curvature_2 = Curvature(Curve=reparameterize(intcrv.Curve), Parameter=crv_cp.Parameter)  # -> P, K, C
darc = DeconstructArc(Arc=curvature_2.C)  # -> BasePlane, simplify(Radius), Angle
clean_6 = CleanTree(RemoveNulls=True, RemoveInvalid=True, RemoveEmpty=False, Tree=darc.Radius)

pt_5 = Point(item_7.Item1)
crv_cp_2 = CurveClosestPoint(Point=pt_5, Curve=intcrv_2.Curve)  # -> Point, Parameter, Distance
curvature_3 = Curvature(Curve=reparameterize(intcrv_2.Curve), Parameter=crv_cp_2.Parameter)  # -> P, K, C
darc_2 = DeconstructArc(Arc=curvature_3.C)  # -> BasePlane, simplify(Radius), Angle
clean_7 = CleanTree(RemoveNulls=True, RemoveInvalid=True, RemoveEmpty=False, Tree=darc_2.Radius)

gradient_2 = Gradient(
    LowerLimit=Slider(2, range=0..10),
    UpperLimit=Slider(10, range=0..100),
    Parameter=clean_6,
    stops=[0: RGB(255, 0, 0), 0.503: RGB(255, 255, 0), 1: RGB(0, 128, 0)])
crv_4 = Curve(graft(remove_last_segment.ListA))

in_out = StreamFilter(Gate=in_out_of_plane_3, Stream0=clean_6, Stream1=clean_7)
gradient_3 = Gradient(
    LowerLimit=minimum_curvature_r,
    UpperLimit=Slider(19.14, range=10..100),
    Parameter=in_out,
    stops=[0: RGB(255, 0, 0), 0.503: RGB(255, 255, 0), 1: RGB(0, 128, 0)])
preview_3 = CustomPreview(Geometry=crv_4, Material=gradient_3)

trim = TrimTree(Tree=clean_6, Depth="2")
sort_4 = SortList(Keys=trim)  # -> Keys, ValuesA
bang_4 = ExplodeTree(Data=sort_4.Keys)  # -> Branch0, Branch1, Branch2, Branch3

trim_2 = TrimTree(Tree=clean_7, Depth="2")
sort_5 = SortList(Keys=trim_2)  # -> Keys, ValuesA
bang_5 = ExplodeTree(Data=sort_5.Keys)  # -> Branch0, Branch1, Branch2, Branch3

# ----
# In plane curvature analysis
number_slider_4 = Slider(30, range=0..100)
gradient_4 = Gradient(
    LowerLimit=Slider(6, range=0..10),
    UpperLimit=number_slider_4,
    Parameter=clean_7,
    stops=[0: RGB(255, 0, 0), 0.503: RGB(255, 255, 0), 1: RGB(0, 128, 0)])
crv_5 = Curve(graft(short.ListA))
preview_4 = CustomPreview(Geometry=crv_5, Material=gradient_4)
panel_10 = Panel(bang_5.Branch1)
panel_11 = Panel(bang_5.Branch2)
panel_12 = Panel(bang_5.Branch3)
panel_13 = Panel(bang_5.Branch0)

# ----
# Out of plane curvature analysis
preview_5 = CustomPreview(Geometry=crv_4, Material=gradient_2)
panel_14 = Panel(bang_4.Branch0)
panel_15 = Panel(bang_4.Branch1)
panel_16 = Panel(bang_4.Branch2)
panel_17 = Panel(bang_4.Branch3)

in_out_of_plane_4 = Data(list_2)
y_diagonals = StreamFilter(Gate=in_out_of_plane_4, Stream0=bang_4.Branch3, Stream1=bang_5.Branch3)
x_rods_7 = StreamFilter(Gate=in_out_of_plane_4, Stream0=bang_4.Branch0, Stream1=bang_5.Branch0)
y_rods_8 = StreamFilter(Gate=in_out_of_plane_4, Stream0=bang_4.Branch1, Stream1=bang_5.Branch1)
x_diagonals = StreamFilter(Gate=in_out_of_plane_4, Stream0=bang_4.Branch2, Stream1=bang_5.Branch2)
roundd_4 = RoundToDecimalPlace(NumberX=x_diagonals, DecimalPlace=2, RoundType=0)  # -> Rounded, Difference
roundd_5 = RoundToDecimalPlace(NumberX=y_diagonals, DecimalPlace=2, RoundType=0)  # -> Rounded, Difference
roundd_6 = RoundToDecimalPlace(NumberX=y_rods_8, DecimalPlace=2, RoundType=0)  # -> Rounded, Difference
roundd_7 = RoundToDecimalPlace(NumberX=x_rods_7, DecimalPlace=2, RoundType=0)  # -> Rounded, Difference

x_rods_curvature_r = Panel(roundd_7.Rounded)
x_diagonals_curvature_r = Panel(roundd_4.Rounded)
y_rods_curvature_r = Panel(roundd_6.Rounded)
y_diagonals_curvature_r = Panel(roundd_5.Rounded)

data_4 = Data(roundd_7.Rounded)
clamp = Clamp(Value=data_4, Domain=" 0 to 100")
item_8 = ListItem(List=clamp, Index=0, Wrap=True)  # -> Item1, Item
avr_2 = Average(Input=clamp)
panel_18 = Panel(item_8.Item1)
# Sistema visualizzazione blu e rossa, ultime bacchette danno valori curvatura nel piano bassi
# MISTERO DELLA FEDE:
# Perché se cambio le dimensioni della sezione variano anche i raggi di curvatura??
panel_19 = Panel(item_8.Item)
panel_20 = Panel(avr_2)

# ---- group: Smaller than and bigger than min curvature r
in_out_of_plane_5 = Data(list_2)
out_of_plane_r = Number(clean_6)
in_plane_r = Number(clean_7)
minimum_curvature_r_2 = Data(filter_6)
x_rods_8 = StreamFilter(Gate=in_out_of_plane_5, Stream0=out_of_plane_r, Stream1=in_plane_r)
crv_6 = Curve(graft(remove_last_segment.ListA))
smaller_4 = SmallerThan(FirstNumber=x_rods_8, SecondNumber=minimum_curvature_r_2)  # -> SmallerThan, OrEqualTo
dispatch_14 = Dispatch(List=crv_6, DispatchPattern=smaller_4.SmallerThan)  # -> ListA, ListB

# ----
bigger_then_min = CustomPreview(Geometry=dispatch_14.ListB, Material=ColourSwatch(SwatchColor=RGB(0, 140, 255)))
less_then_min = CustomPreview(Geometry=dispatch_14.ListA, Material=ColourSwatch(SwatchColor=RGB(255, 0, 0)))
preview_6 = CustomPreview(Geometry=[item_5.Item, item_5.Item1], Material=ColourSwatch(SwatchColor=RGBA(150, 150, 150, 116)))

# ---- group: ;ain Grid min r
item_9 = ListItem(List=panel_14, Index=0, Wrap=True)
item_10 = ListItem(List=panel_13, Index=0, Wrap=True)
item_11 = ListItem(List=panel_15, Index=0, Wrap=True)
item_12 = ListItem(List=panel_10, Index=0, Wrap=True)
sort_6 = SortList(Keys=flatten([item_9, item_11, item_10, item_12]))  # -> Keys, ValuesA
item_13 = ListItem(List=sort_6.Keys, Index=0, Wrap=True)
panel_21 = Panel(item_13)

# ---- group: Diagonals min r
item_14 = ListItem(List=panel_16, Index=0, Wrap=True)
item_15 = ListItem(List=panel_11, Index=0, Wrap=True)
item_16 = ListItem(List=panel_17, Index=0, Wrap=True)
item_17 = ListItem(List=panel_12, Index=0, Wrap=True)
sort_7 = SortList(Keys=flatten([item_14, item_16, item_15, item_17]))  # -> Keys, ValuesA
item_18 = ListItem(List=sort_7.Keys, Index=0, Wrap=True)
panel_22 = Panel(item_18)

# ==== cluster PolyLineBend: PolyLineBend
polyline = ClusterInput()
polyline_2 = Curve(polyline)
cls = Closed(Curve=polyline_2)  # -> Closed, Periodic
explode = Explode(Curve=polyline_2, Recursive=True)  # -> Segments, Vertices
split = SplitList(List=explode.Vertices, Index=1)  # -> ListA, ListB
shift = ShiftList(List=explode.Vertices, Shift=0, Wrap=False)
shift_2 = ShiftList(List=explode.Vertices, Shift=1, Wrap=False)
shift_3 = ShiftList(List=explode.Vertices, Shift=2, Wrap=False)
shift_4 = ShiftList(List=split.ListB, Shift=0, Wrap=True)
shift_5 = ShiftList(List=split.ListB, Shift=1, Wrap=True)
shift_6 = ShiftList(List=split.ListB, Shift=2, Wrap=True)
filter = StreamFilter(Gate=cls.Closed, Stream0=shift_3, Stream1=shift_6)
filter_2 = StreamFilter(Gate=cls.Closed, Stream0=shift_2, Stream1=shift_5)
filter_3 = StreamFilter(Gate=cls.Closed, Stream0=shift, Stream1=shift_4)
short = ShortList(ListA=filter_3, ListB=filter_2, TrimMode=2)  # -> ListA, ListB
short_2 = ShortList(ListA=filter_3, ListB=filter_2, ListC=filter, TrimMode=2)  # -> ListA, ListB, ListC
ln = Line(StartPoint=short.ListA, EndPoint=short.ListB)
L = ClusterOutput(ln)
vec2pt = Vector2Pt(PointA=short_2.ListA, PointB=short_2.ListB, Unitize=False)  # -> Vector, Length
vec2pt_2 = Vector2Pt(PointA=short_2.ListB, PointB=short_2.ListC, Unitize=False)  # -> Vector, Length
angle = Angle(VectorA=vec2pt.Vector, VectorB=vec2pt_2.Vector)  # -> Angle, Reflex
B = ClusterInput()
multiplication = Multiplication(A=angle.Angle, B=B)
bendstrength = ClusterInput()
bend = Bend(Point1=short_2.ListA, Point2=short_2.ListB, Point3=short_2.ListC, BendStrength=bendstrength, RestAngle=multiplication)
B_2 = ClusterOutput(bend)

# ==== cluster Diagonals: Generate diagonals from grid segments
T = ClusterInput()
tstat = TreeStatistics(Tree=T)  # -> Paths, Length, Count
series = Series(Start=0, Step=1, Count=tstat.Count)
dispatch = Dispatch(List=series, DispatchPattern=[True, False])  # -> ListA, ListB
branch = TreeBranch(Tree=T, Path=dispatch.ListB, MaintainPaths=True)
branch_2 = TreeBranch(Tree=T, Path=dispatch.ListA, MaintainPaths=True)
shift = ShiftList(List=branch, Shift=1, Wrap=True)
merge = Merge(Data1=branch_2, Data2=simplify(shift))
cull = CullPattern(List=merge, CullPattern=[False, True])  # -> flatten(List)
join = JoinCurves(Curves=cull, Preserve=False)
C = ClusterOutput(join)

# ==== cluster OrientAlongRod: Orient the choosen section along the rods
geometry = ClusterInput()  # Geometry to orient
points = ClusterInput()  # Points on surface
shift_list = ShiftList(List=points, Shift=1, Wrap=invert(True))
normal_vectors = ClusterInput()
vector_2pt = Vector2Pt(PointA=points, PointB=shift_list, Unitize=False)  # -> Vector, Length
n_vectors = UnitVector(Vector=normal_vectors)
item = ListItem(List=points, Index=0, Wrap=True)  # -> Item2, Item1, Item
item_2 = ListItem(List=vector_2pt.Vector, Index=0, Wrap=True)  # -> Item1, Item
orient = Orient(Geometry=item_2.Item1, Source=item.Item2, Target=item.Item1)  # -> Geometry, Transform
merge = Merge(Data1=simplify(vector_2pt.Vector), Data2=simplify(orient.Geometry))
pl = ConstructPlane(Origin=points, XAxis=n_vectors, YAxis=merge)
prot = RotatePlane(Plane=pl, Angle=degrees("90"))
area = Area(Geometry=geometry)  # -> Area, Centroid
orient_2 = Orient(Geometry=graft(geometry), Source=area.Centroid, Target=prot)  # -> Geometry, Transform
n_vector = Vector(n_vectors)
points_2 = Point(points)
rotate_3d = Rotate3D(Geometry=orient_2.Geometry, Angle=degrees("90"), Center=points_2, Axis=n_vector)  # -> simplify(Geometry), Transform
clean_tree = CleanTree(RemoveNulls=True, RemoveInvalid=True, RemoveEmpty=False, Tree=rotate_3d.Geometry)
tree = ClusterOutput(clean_tree)

# ==== cluster GridPointsOnSurface: Generates vertices of the deformed grid and gets their position and normal on the global surface
curves = ClusterInput()  # Rod segments
join = JoinCurves(Curves=flatten(curves), Preserve=False)  # -> graft(Curves)
explode = Explode(Curve=join, Recursive=True)  # -> Segments, Vertices
end = EndPoints(Curve=explode.Segments)  # -> Start, End
S = ClusterInput()
cullpt = CullDuplicates(Points=[end.Start, end.End], Tolerance=0.1, CullMode=3)  # -> Points, Indices, Valence
srf_cp = SurfaceClosestPoint(Point=cullpt.Points, Surface=S)  # -> Point, UVPoint, Distance
Z = UnitZ(Factor=1)  # -> expr("-x", UnitVector)
evalsrf = EvaluateSurface(Surface=S, Point=srf_cp.UVPoint)  # -> Point, Normal, UDirection, VDirection, Frame
P = ClusterOutput(evalsrf.Point)
dprod = DotProduct(VectorA=evalsrf.Normal, VectorB=Z, Unitize=False)
avr = Average(Input=flatten(dprod))
expression = Expression(d=avr, Expression="if(d < 0, -1, 1)")
multiplication = Multiplication(A=evalsrf.Normal, B=expression)
neg = Negative(Value=evalsrf.Normal)
vdis = VectorDisplay(Anchor=evalsrf.Point, Vector=multiplication)
R = ClusterOutput(multiplication)
