# Grasshopper definition GridMaker.gh (Grasshopper 1.0.8)
# plug-ins: RhinoCodePluginGH, Pufferfish, GridshellTools

# ----
# Axis Starting Point
x_coordinate = Slider(0.488, range=0.375..0.625)
number_slider = Slider(0.541, range=0.375..0.625)

# ----
# Axis Angle
axis_angle = Slider(1, range=-10..10)

# ----
# Axis Rotation
axis_rotation = Slider(37, range=-90..90)

# ----
# Target Surface
# Grid Span
grid_span = ValueList({"25 cm": 0.25, "45 cm": 0.45, "50 cm": 0.50, "55 cm": 0.55, "60 cm": 0.60, "70 cm": 0.70, "100 cm": 1.00}, selected="60 cm")
# CMMKM
target_surface = Surface(<surface referenced from the Rhino model>)

surface = Surface(target_surface)

# ----
# Get Starting Pt Z
number_slider_2 = Slider(10, range=0..100)
sdivide = DivideSurface(Surface=surface, UCount=number_slider_2, VCount=number_slider_2)  # -> Points, Normals, Parameters
evalsrf = EvaluateSurface(Surface=surface, Point=sdivide.Parameters)  # -> flatten(Point), Normal, UDirection, VDirection, Frame
pdecon = Deconstruct(Point=evalsrf.Point)  # -> XComponent, YComponent, ZComponent
sort = SortList(Keys=pdecon.ZComponent)  # -> reverse(Keys), ValuesA
item = ListItem(List=sort.Keys, Index=0, Wrap=True)
addition = Addition(A=item, B="1")

# ----
# architettura e design
# Grid_PRO
# Galapagos
galapagos = Galapagos(fitness=addition_2, gene=[x_coordinate, number_slider, axis_angle, axis_rotation])

# ----
# Move Srf to 0,0,0
area = Area(Geometry=surface)  # -> Area, Centroid
pdecon_2 = Deconstruct(Point=area.Centroid)  # -> XComponent, YComponent, ZComponent
pt = ConstructPoint(XCoordinate=pdecon_2.XComponent, YCoordinate=pdecon_2.YComponent, ZCoordinate=0)
move2pt = MoveToPoint(Geometry=surface, PointA=pt, PointB="0,0,0")  # -> Moved, Vector, Transform
pt_2 = ConstructPoint(XCoordinate=x_coordinate, YCoordinate=number_slider, ZCoordinate=0)
evalsrf_2 = EvaluateSurface(Surface=reparameterize(move2pt.Moved), Point=pt_2)  # -> Point, Normal, UDirection, VDirection, Frame

# ----
# Construct Starting Pt
pdecon_3 = Deconstruct(Point=evalsrf_2.Point)  # -> XComponent, YComponent, ZComponent
starting_pt = ConstructPoint(XCoordinate=pdecon_3.XComponent, YCoordinate=pdecon_3.YComponent, ZCoordinate=addition)

startng_pt = Point(starting_pt)
startng_pt_2 = Point(starting_pt)

# ----
# Construct Axis Pts
unit_x = UnitX(Factor=1)
unit_x_2 = UnitX(Factor=1)
unit_y = UnitY(Factor=1)
unit_y_2 = UnitY(Factor=1)
move = Move(Geometry=starting_pt, Motion=expr("-x", unit_x_2))  # -> Geometry, Transform
move_2 = Move(Geometry=starting_pt, Motion=expr("-x", unit_y_2))  # -> Geometry, Transform
move_3 = Move(Geometry=starting_pt, Motion=unit_x)  # -> Geometry, Transform
move_4 = Move(Geometry=starting_pt, Motion=unit_y)  # -> Geometry, Transform
axis_angle_2 = Number(axis_angle)
axisangle = Rotate(Geometry=[move_3.Geometry, move.Geometry], Angle=degrees(axis_angle_2), Plane=startng_pt)  # -> Geometry, Transform
item_2 = ListItem(List=axisangle.Geometry, Index=0, Wrap=True)  # -> Item, Item1
merge = Merge(Data1=item_2.Item, Data2=move_4.Geometry, Data3=item_2.Item1, Data4=move_2.Geometry)
axis_rotation_2 = Number(axis_rotation)
axis_rotation_3 = Rotate(Geometry=merge, Angle=degrees(axis_rotation_2), Plane=startng_pt_2)  # -> Geometry, Transform

# ----
# Construct Axis
grid_span_2 = Number(grid_span)
startng_pt_3 = Point(starting_pt)
geodesicinitialvalue = GeodesicInitialValue(Surface=move2pt.Moved, Point=startng_pt_3, Point2=axis_rotation_3.Geometry, Span=grid_span_2, BothSides=False)  # -> Points, Circles

# ----
# Cull Pts for Trimmed Surfaces
target_srf = Surface(move2pt.Moved)
srf_cp = SurfaceClosestPoint(Point=geodesicinitialvalue.Points, Surface=target_srf)  # -> Point, UVPoint, Distance
smaller = SmallerThan(FirstNumber=srf_cp.Distance, SecondNumber="0.01")  # -> SmallerThan, OrEqualTo
dispatch = Dispatch(List=srf_cp.Point, DispatchPattern=smaller.SmallerThan)  # -> ListA, ListB
axis_pts = Point(dispatch.ListA)

merge_2 = Merge(Data1="0", Data2="2")
construct_path = ConstructPath(Indices=merge_2)
axis_pts_2 = Point(dispatch.ListA)
tree_branch = TreeBranch(Tree=axis_pts_2, Path=construct_path, MaintainPaths=True)

merge_3 = Merge(Data1="0", Data2="3")
construct_path_2 = ConstructPath(Indices=merge_3)
axis_pts_3 = Point(dispatch.ListA)
tree_branch_2 = TreeBranch(Tree=axis_pts_3, Path=construct_path_2, MaintainPaths=True)

merge_4 = Merge(Data1="0", Data2="0")
construct_path_3 = ConstructPath(Indices=merge_4)
axis_pts_4 = Point(dispatch.ListA)
tree_branch_3 = TreeBranch(Tree=axis_pts_4, Path=construct_path_3, MaintainPaths=True)

merge_5 = Merge(Data1="0", Data2="1")
construct_path_4 = ConstructPath(Indices=merge_5)
axis_pts_5 = Point(dispatch.ListA)
tree_branch_4 = TreeBranch(Tree=axis_pts_5, Path=construct_path_4, MaintainPaths=True)

target_srf_2 = Surface(move2pt.Moved)
grid_span_3 = Number(grid_span)

# ----
# Grid on Surface
swatch = ColourSwatch(SwatchColor=RGB(255, 254, 254))

# ----
# Planar Grid/Trim Geo
# Curve Costrain
# Ground Pts Selection
move_planar_grid = Slider(12.65, range=0..50)
ground_pts_max_z = Slider(0.1, range=0.01..0.5)

ground_pts_max_z_2 = Number(ground_pts_max_z)
simple_chebyshev_1_1 = CSharpScript(
    Surface=target_srf_2,
    uPoints=tree_branch_3,
    vPoints=tree_branch_4,
    uNPoints=tree_branch,
    vNPoints=tree_branch_2,
    Span=grid_span_3,
    Tolerance=0.05,
    GroundPtsMaxZ=ground_pts_max_z_2)  # -> out, Net, Indices, Rows, Columns, PlanarRows, PlanarColumns, NodeAngle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; inputs Surface: Brep, uPoints: list of Point3d, vPoints: list of Point3d, uNPoints: list of Point3d, vNPoints: list of Point3d, Span: Double, Tolerance: Double, GroundPtsMaxZ: Double
#   port Surface: Target surface to draw the grid on
#   port Span: Grid span in meters
# ---------- simple_chebyshev_1_1: C# ----------
// USING DIRECTIVES
using System;
using System.Collections.Generic;
using System.Linq;
using Grasshopper;
using Grasshopper.Kernel;
using Grasshopper.Kernel.Data;
using Rhino.Geometry;
using Rhino.Geometry.Collections;
using Rhino.Geometry.Intersect;

// SCRIPT CLASS
public class Script_Instance : GH_ScriptInstance
{
  // MODIFICATO: Aggiunto input GroundPtsMaxZ
  private void RunScript(
	Brep Surface,
	List<Point3d> uPoints,
	List<Point3d> vPoints,
	List<Point3d> uNPoints,
	List<Point3d> vNPoints,
	double Span,
	double Tolerance,
	double GroundPtsMaxZ,
	ref object Net,
	ref object Indices,
	ref object Rows,
	ref object Columns,
	ref object PlanarRows,
	ref object PlanarColumns,
	ref object NodeAngle,
	ref object NodeUCurvature,
	ref object NodeVCurvature,
	ref object PlanarNet,
	ref object BoundaryCurve,
	ref object GroundPts)
  {
    // ===================================================================================
    // LOGICA PRINCIPALE DEL COMPONENTE (Base V7.6)
    // ===================================================================================

    // Inputs
    Brep inSrf = Surface;
    double inSpan = Span;
    double inTolerance = Tolerance;
    // double inGroundPtsMaxZ = GroundPtsMaxZ; // Non serve variabile extra

    // Converte Point3d in Point
    List<Point> uPtsList = uPoints.Select(p => new Point(p)).ToList();
    List<Point> vPtsList = vPoints.Select(p => new Point(p)).ToList();
    List<Point> uNPtsList = uNPoints.Select(p => new Point(p)).ToList();
    List<Point> vNPtsList = vNPoints.Select(p => new Point(p)).ToList();


    // Controlla buchi
    if (inSrf != null) { foreach (BrepLoop loop in inSrf.Loops) { if (loop.LoopType == BrepLoopType.Inner) { /*...*/ } } } else { return; }


    // Outputs
    DataTree<Point3d> outNetPts = new DataTree<Point3d>();
    DataTree<Point3d> outPlanarNet = new DataTree<Point3d>();
    DataTree<String> outIndices = new DataTree<String>();
    DataTree<Curve> outRows = new DataTree<Curve>();
    DataTree<Curve> outColumns = new DataTree<Curve>();
    DataTree<Curve> outPlanarRows = new DataTree<Curve>();
    DataTree<Curve> outPlanarColumns = new DataTree<Curve>();
    DataTree<double> outNodeAngles = new DataTree<double>();
    DataTree<double> outNodeUCurv = new DataTree<double>();
    DataTree<double> outNodeVCurv = new DataTree<double>();
    PolylineCurve outBoundaryCurve = null;
    List<Point3d> outGroundPts = new List<Point3d>();


    // Logica
    ChebyshevNet net = new ChebyshevNet(uPtsList, vPtsList, uNPtsList, vNPtsList, inSpan, inTolerance, inSrf);
    do { while (net.QueueGhostNodes()) { net.CreateQueuedNodes(); } } while (net.TryExtendBorderNode());
    net.CreateSurfaceEdgeNodes();
    net.CalculateRowsAndColumns();
    net.IdentifyBoundaryNodes(); // Sovrascrive IsOnEdge

    // Ottieni la lista ordinata dei NODI di bordo
    List<ChebyshevNode> orderedEdgeNodes = TryGetOrderedBoundaryNodes(net);

    // Filtra per Z < GroundPtsMaxZ e crea curva/lista filtrata
    if (orderedEdgeNodes != null && orderedEdgeNodes.Count > 2)
    {
        List<Point3d> pointsForCurve = new List<Point3d>(); // Lista completa per la curva

        foreach(ChebyshevNode edgeNode in orderedEdgeNodes)
        {
            if (edgeNode.PlanarLocation.IsValid)
            {
                 pointsForCurve.Add(edgeNode.PlanarLocation); // Aggiungi sempre alla lista per la curva

                 // MODIFICATO: Usa la variabile di input
                 if (edgeNode.location.Z < GroundPtsMaxZ)
                 {
                     outGroundPts.Add(edgeNode.PlanarLocation); // Popola nuovo output
                 }
            }
        }

        // Pulisci e crea BoundaryCurve dalla lista COMPLETA (pointsForCurve)
        if (pointsForCurve.Count > 2)
        {
            List<Point3d> culledPoints = new List<Point3d>();
            if (!pointsForCurve[0].IsValid) goto AssignOutputs;
            culledPoints.Add(pointsForCurve[0]);
            double toleranceSquared = 0.001 * 0.001;
            for(int i = 1; i < pointsForCurve.Count; i++) { if (!pointsForCurve[i].IsValid) continue; if (pointsForCurve[i].DistanceToSquared(culledPoints.Last()) > toleranceSquared) { culledPoints.Add(pointsForCurve[i]); } }
            if (culledPoints.Count > 2) { if (culledPoints.First().DistanceToSquared(culledPoints.Last()) > toleranceSquared) { culledPoints.Add(culledPoints[0]); } if (culledPoints.Count > 3) { Polyline finalPolyline = new Polyline(culledPoints); if (finalPolyline.IsValid && finalPolyline.IsClosed) { outBoundaryCurve = new PolylineCurve(finalPolyline); } } }
        }
    }


    AssignOutputs:; // Etichetta per saltare qui

    // Assegnazione Outputs (con logica V7.3 per angle/curvature)
    var allEdgeNodesForOutput = new List<ChebyshevNode>();
    foreach (var n in net.nodes)
    {
      ChebyshevNode node = n.Value;
      GH_Path path = new GH_Path(n.Key.Item1, n.Key.Item2);
      if (node.IsReal)
      {
        outNetPts.Add(node.location, path);
        if(node.PlanarLocation.IsValid) outPlanarNet.Add(node.PlanarLocation, path);
        outIndices.Add($"({n.Key.Item1},{n.Key.Item2})", path);

        if (!node.IsOnEdge) { // Calcola solo per nodi INTERNI
          double angle = Math.Abs((Math.PI * 0.5) - node.GetAngle());
          outNodeAngles.Add(angle, path);
          double[] curvatures = node.GetCurvature();
          outNodeUCurv.Add(curvatures[0], path);
          outNodeVCurv.Add(curvatures[1], path);
        } else { // Per nodi SUL BORDO, aggiungi valori dummy
          outNodeAngles.Add(0.0, path);
          outNodeUCurv.Add(0.0, path);
          outNodeVCurv.Add(0.0, path);
        }

        foreach (var edgeNode in node.EdgeExtensions) { if (edgeNode != null) { if (!allEdgeNodesForOutput.Contains(edgeNode)) { allEdgeNodesForOutput.Add(edgeNode); } } }
      }
    }
    foreach(var edgeNode in allEdgeNodesForOutput)
    {
        GH_Path oosPath = new GH_Path(edgeNode.Coords.Item1, edgeNode.Coords.Item2);
        if (!outNetPts.PathExists(oosPath) || !outNetPts.Branch(oosPath).Contains(edgeNode.location)) { outNetPts.Add(edgeNode.location, oosPath); }
        if (edgeNode.PlanarLocation.IsValid && (!outPlanarNet.PathExists(oosPath) || !outPlanarNet.Branch(oosPath).Contains(edgeNode.PlanarLocation))) {
           outPlanarNet.Add(edgeNode.PlanarLocation, oosPath);
           if (!outIndices.PathExists(oosPath)) {
               outIndices.Add($"({edgeNode.Coords.Item1},{edgeNode.Coords.Item2})", oosPath);
               if (!outNodeAngles.PathExists(oosPath)) outNodeAngles.Add(0d, oosPath);
               if (!outNodeUCurv.PathExists(oosPath)) outNodeUCurv.Add(0d, oosPath);
               if (!outNodeVCurv.PathExists(oosPath)) outNodeVCurv.Add(0d, oosPath);
           }
        }
    }

    // Generazione Curve
    foreach (var r in net.Rows) { GH_Path path = new GH_Path(r.Key); List<Point3d> ptList = new List<Point3d>(); foreach (var node in r.Value) { if (node == null) continue; if (node.EdgeExtensions[2] != null) ptList.Add(node.EdgeExtensions[2].location); ptList.Add(node.location); if (node.EdgeExtensions[0] != null) ptList.Add(node.EdgeExtensions[0].location); } CreateAndAddFilteredPolylines(outRows, path, ptList, inSpan, inTolerance); }
    foreach (var c in net.Columns) { GH_Path path = new GH_Path(c.Key); List<Point3d> ptList = new List<Point3d>(); foreach (var node in c.Value) { if (node == null) continue; if (node.EdgeExtensions[3] != null) ptList.Add(node.EdgeExtensions[3].location); ptList.Add(node.location); if (node.EdgeExtensions[1] != null) ptList.Add(node.EdgeExtensions[1].location); } CreateAndAddFilteredPolylines(outColumns, path, ptList, inSpan, inTolerance); }
    foreach (var r in net.PlanarRows) { GH_Path path = new GH_Path(r.Key); List<Point3d> ptList = ChebyshevNet.GetNodePlanarLocationList(r.Value); CreateAndAddFilteredPolylines(outPlanarRows, path, ptList, inSpan, inTolerance); }
    foreach (var c in net.PlanarColumns) { GH_Path path = new GH_Path(c.Key); List<Point3d> ptList = ChebyshevNet.GetNodePlanarLocationList(c.Value); CreateAndAddFilteredPolylines(outPlanarColumns, path, ptList, inSpan, inTolerance); }

    // Assegna output finali
    Net = outNetPts; PlanarNet = outPlanarNet; Indices = outIndices; Rows = outRows; Columns = outColumns; PlanarRows = outPlanarRows; PlanarColumns = outPlanarColumns; NodeAngle = outNodeAngles; NodeUCurvature = outNodeUCurv; NodeVCurvature = outNodeVCurv;
    BoundaryCurve = outBoundaryCurve;
    GroundPts = outGroundPts; // <-- Modificato
  }

  // <Custom additional code>

  // --- FUNZIONE CreateAndAddFilteredPolylines --- (invariata)
  private void CreateAndAddFilteredPolylines(DataTree<Curve> tree, GH_Path path, List<Point3d> points, double span, double tolerance) { if (points.Count < 2) return; double maxSqLength = (span + tolerance) * (span + tolerance); List<Point3d> currentSegmentPoints = new List<Point3d>(); currentSegmentPoints.Add(points[0]); for (int i = 1; i < points.Count; i++) { if (points[i - 1].DistanceTo(points[i]) < 1e-6) continue; if (points[i - 1].DistanceToSquared(points[i]) > maxSqLength) { if (currentSegmentPoints.Count > 1) { tree.Add(new PolylineCurve(currentSegmentPoints), path); } currentSegmentPoints = new List<Point3d>(); } if(currentSegmentPoints.Count == 0) currentSegmentPoints.Add(points[i]); else if (currentSegmentPoints[currentSegmentPoints.Count - 1] != points[i]) currentSegmentPoints.Add(points[i]); } if (currentSegmentPoints.Count > 1) { tree.Add(new PolylineCurve(currentSegmentPoints), path); } }

  // --- FUNZIONE PER OTTENERE I NODI DI CONTORNO ORDINATI ---
  private List<ChebyshevNode> TryGetOrderedBoundaryNodes(ChebyshevNet net) // <-- Modificato tipo restituito
  {
      var edgeNodesByParentCoords = new Dictionary<(int, int), List<ChebyshevNode>>();
      var allEdgeNodesList = new List<ChebyshevNode>();
      foreach (var n in net.nodes) { if (!n.Value.IsReal) continue; foreach (var edgeNode in n.Value.EdgeExtensions) { if (edgeNode != null && edgeNode.PlanarLocation.IsValid && edgeNode.ParentCoords != (-999,-999)) { allEdgeNodesList.Add(edgeNode); if (!edgeNodesByParentCoords.TryGetValue(edgeNode.ParentCoords, out var listParent)) { listParent = new List<ChebyshevNode>(); edgeNodesByParentCoords.Add(edgeNode.ParentCoords, listParent); } listParent.Add(edgeNode); } } }
      if (allEdgeNodesList.Count < 3) return null;
      ChebyshevNode startEdgeNode = allEdgeNodesList.OrderBy(en => en.PlanarLocation.X).ThenBy(en => en.PlanarLocation.Y).First();
      var startSegment = (startEdgeNode.ParentCoords, startEdgeNode.Coords);
      List<ChebyshevNode> orderedBoundaryNodes = new List<ChebyshevNode>(); // <-- Modificato tipo lista
      HashSet<((int, int), (int, int))> visitedSegments = new HashSet<((int, int), (int, int))>();
      ChebyshevNode currentEdgeNode = startEdgeNode;
      if (!net.nodes.TryGetValue(startEdgeNode.ParentCoords, out ChebyshevNode currentNode)) return null;
      int currentExitDir = -1;
      var initialNeighbours = currentNode.NeighboursCoords; for (int i = 0; i < 4; i++) { if (initialNeighbours[i] == startEdgeNode.Coords) { currentExitDir = i; break; } } if (currentExitDir == -1) return null;
      orderedBoundaryNodes.Add(startEdgeNode); // <-- Aggiunge il NODO
      visitedSegments.Add(startSegment);
      for (int iter = 0; iter < allEdgeNodesList.Count * 3 + 3; iter++) { bool foundNextStep = false; var neighboursCoords = currentNode.NeighboursCoords; for (int k = 1; k < 4; k++) { int checkDir = (currentExitDir + k) % 4; (int, int) neighborCoords = neighboursCoords[checkDir]; ChebyshevNode foundDirectEdge = null; if (edgeNodesByParentCoords.TryGetValue(currentNode.Coords, out var potentialEdgeNodes)) { foundDirectEdge = potentialEdgeNodes.FirstOrDefault(en => en.Coords == neighborCoords); } if (foundDirectEdge != null) { var segmentTuple = (foundDirectEdge.ParentCoords, foundDirectEdge.Coords); if (segmentTuple == startSegment) { if (orderedBoundaryNodes.Count >= 2) { foundNextStep = true; goto EndLoop; } else return null; } if (visitedSegments.Contains(segmentTuple)) continue; orderedBoundaryNodes.Add(foundDirectEdge); // <-- Aggiunge il NODO
      visitedSegments.Add(segmentTuple); currentEdgeNode = foundDirectEdge; currentExitDir = checkDir; foundNextStep = true; break; } ChebyshevNode neighborNode = null; bool neighborExists = net.nodes.TryGetValue(neighborCoords, out neighborNode); if (neighborExists && neighborNode.IsReal) { if (neighborNode.IsOnEdge) { currentNode = neighborNode; int arrivalDirForB = (checkDir + 2) % 4; currentExitDir = arrivalDirForB; foundNextStep = true; break; } else { ChebyshevNode internalNode = neighborNode; int internalArrivalDir = (checkDir + 2) % 4; bool foundWayBackToEdge = false; HashSet<(int, int)> visitedInternalNodes = new HashSet<(int, int)> { currentNode.Coords, internalNode.Coords }; for (int iterC = 0; iterC < net.nodes.Count; iterC++) { bool movedInternally = false; var internalNeighboursCoords = internalNode.NeighboursCoords; for (int kC = 1; kC < 4; kC++) { int checkDirC = (internalArrivalDir + kC) % 4; (int, int) internalNeighborCoords = internalNeighboursCoords[checkDirC]; if (net.nodes.TryGetValue(internalNeighborCoords, out ChebyshevNode internalNeighborNode) && internalNeighborNode.IsReal) { if (internalNeighborNode.IsOnEdge) { currentNode = internalNeighborNode; int arrivalDirForEdgeNode = (checkDirC + 2) % 4; currentExitDir = arrivalDirForEdgeNode; foundNextStep = true; foundWayBackToEdge = true; break; } else { if (!visitedInternalNodes.Add(internalNeighborCoords)) continue; internalNode = internalNeighborNode; internalArrivalDir = (checkDirC + 2) % 4; movedInternally = true; break; } } } if (foundWayBackToEdge) break; if (!movedInternally) return null; } if(foundWayBackToEdge) break; else return null; } } } if (!foundNextStep) { /* Uscita Anticipata */ return orderedBoundaryNodes.Count > 2 ? orderedBoundaryNodes : null; } } // Fine loop k
      // Fine loop iter
      EndLoop:; // Salta qui quando il loop è completo

      return orderedBoundaryNodes.Count > 2 ? orderedBoundaryNodes : null; // <-- Restituisce lista di NODI
  }


  // Classe Point3dEqualityComparer (necessaria)
  public class Point3dEqualityComparer : IEqualityComparer<Point3d> { private double toleranceSquared; public Point3dEqualityComparer(double tol) { toleranceSquared = tol * tol; } public bool Equals(Point3d p1, Point3d p2) { if (!p1.IsValid || !p2.IsValid) return false; return p1.DistanceToSquared(p2) <= toleranceSquared; } public int GetHashCode(Point3d p) { if (!p.IsValid) return 0; return p.X.GetHashCode() ^ p.Y.GetHashCode() ^ p.Z.GetHashCode(); } }

} // <-- FINE DELLA CLASSE Script_Instance


// ===================================================================================
// CLASSI DI SUPPORTO (Base V5.4 + ParentCoords + IdentifyBoundaryNodes)
// ===================================================================================

// --- CLASSE ChebyshevNodeComparer --- (invariata)
class ChebyshevNodeComparer : IComparer<ChebyshevNode> { bool compareU; public ChebyshevNodeComparer (bool compareU) { this.compareU = compareU; } public int Compare(ChebyshevNode xNode, ChebyshevNode yNode) { if (xNode == null) { if (yNode == null) return 0; else return -1; } else { if (yNode == null) return 1; if (compareU) return xNode.U.CompareTo(yNode.U); else return xNode.V.CompareTo(yNode.V); } } }

// --- CLASSE GeodesicInitialValue --- (invariata)
public static class GeodesicInitialValue { internal static Point NextGeodesicPoint(Brep srf, Point3d pt1, Point3d pt2) { Vector3d normal; srf.ClosestPoint(pt1, out _, out _, out _, out _, 10d, out normal); Vector3d dir = pt2 - pt1; Plane plane = new Plane(pt1, dir, normal); double radius = dir.Length; Circle circle = new Circle(plane, plane.Origin, radius); Curve intersectionCircle = circle.ToNurbsCurve(); Point3d[] ptInts; Intersection.CurveBrep(intersectionCircle, srf, 0.001d, out _, out ptInts); if (ptInts.Length < 2) return null; List<Point3d> goodInts = new List<Point3d>(); for (int i = 0; i < ptInts.Length; i++) { if (!ptInts[i].EpsilonEquals(pt2, radius * 0.1d)) { goodInts.Add(ptInts[i]); } } if (goodInts.Count > 0) return new Point(goodInts[0]); else return null; } }

// --- CLASSE ChebyshevNet --- (Logica V5.4 + IdentifyBoundaryNodes + CreateSurfaceEdgeNodes modificato)
class ChebyshevNet
{
  internal double gridSpan; internal double tolerance; internal Brep srf; internal Dictionary<(int, int), ChebyshevNode> nodes; Queue<ChebyshevNode> queueNodes; Dictionary<int, List<ChebyshevNode>> rows; internal Dictionary<int, List<ChebyshevNode>> Rows { get => rows; } Dictionary<int, List<ChebyshevNode>> columns; internal Dictionary<int, List<ChebyshevNode>> Columns { get => columns; } Dictionary<int, List<ChebyshevNode>> planarRows; internal Dictionary<int, List<ChebyshevNode>> PlanarRows { get => planarRows; } Dictionary<int, List<ChebyshevNode>> planarColumns; internal Dictionary<int, List<ChebyshevNode>> PlanarColumns { get => planarColumns; }
  public ChebyshevNet(List<Point> uPts, List<Point> vPts, List<Point> uNPts, List<Point> vNPoints, double gridSpan, double tolerance, Brep srf) { this.gridSpan = gridSpan; this.tolerance = tolerance; this.srf = srf; nodes = new Dictionary<(int, int), ChebyshevNode>(); queueNodes = new Queue<ChebyshevNode>(); this.rows = new Dictionary<int, List<ChebyshevNode>>(); this.columns = new Dictionary<int, List<ChebyshevNode>>(); this.planarRows = new Dictionary<int, List<ChebyshevNode>>(); this.planarColumns = new Dictionary<int, List<ChebyshevNode>>(); for (int i = 0; i < uPts.Count; i++) { (int, int) coords = (i, 0); nodes.Add(coords, new ChebyshevNode(this, coords, uPts[i].Location)); } for (int i = 1; i < vPts.Count; i++) { (int, int) coords = (0, i); nodes.Add(coords, new ChebyshevNode(this, coords, vPts[i].Location)); } for (int i = 1; i < uNPts.Count; i++) { (int, int) coords = (-i, 0); nodes.Add(coords, new ChebyshevNode(this, coords, uNPts[i].Location)); } for (int i = 1; i < vNPoints.Count; i++) { (int, int) coords = (0, -i); nodes.Add(coords, new ChebyshevNode(this, coords, vNPoints[i].Location)); } }

  // QueueGhostNodes CON controllo IsOnEdge (Logica V5.4)
  internal bool QueueGhostNodes() { Dictionary<(int, int), ChebyshevNode> tempNodes = new Dictionary<(int, int), ChebyshevNode>(); foreach (var n in nodes) { if (n.Value.IsGhost || n.Value.IsOutOfSurface) continue; (int, int)[] nCoords = n.Value.NeighboursCoords; for (int i = 0; i < nCoords.Length; i++) { ChebyshevNode neighbour; if(!nodes.TryGetValue(nCoords[i], out neighbour)) { if (n.Value.IsOnEdge) continue; /* CONTROLLO IsOnEdge PRESENTE */ if (!tempNodes.TryGetValue(nCoords[i], out neighbour)) { ChebyshevNode newNode = new ChebyshevNode(this, nCoords[i]); newNode.AddNeighbour(n.Key, n.Value); n.Value.AddNeighbour(nCoords[i], newNode); tempNodes.Add(nCoords[i], newNode); } else { neighbour.AddNeighbour(n.Key, n.Value); n.Value.AddNeighbour(nCoords[i], neighbour); if (neighbour.HasDiagonalNeighbours) { queueNodes.Enqueue(neighbour); } } } else { neighbour.AddNeighbour(n.Key, n.Value); n.Value.AddNeighbour(nCoords[i], neighbour); if (neighbour.HasDiagonalNeighbours && neighbour.IsGhost) { queueNodes.Enqueue(neighbour); } } } } foreach(var n in tempNodes) { nodes.Add(n.Key, n.Value); } return queueNodes.Any(); }
  internal void CreateQueuedNodes() { while(queueNodes.Any()) { ChebyshevNode n = queueNodes.Dequeue(); n.CreateGeometricNode(gridSpan, srf); } }

  // TryExtendBorderNode CON controllo IsOnEdge (Logica V5.4)
  internal bool TryExtendBorderNode() { foreach (var n in this.nodes) { ChebyshevNode node = n.Value; if (!node.IsGhost) continue; List<ChebyshevNode> neighbours = new List<ChebyshevNode>(); for (int i = 0; i < node.Neighbours.Length; i++) { if (node.Neighbours[i] != null) neighbours.Add(node.Neighbours[i]); } if(neighbours.Count == 0) continue; ChebyshevNode originNode = neighbours[0]; if (originNode.IsOnEdge) { node.nodeState = ChebyshevNode.NodeState.OutOfSurface; continue; } /* CONTROLLO IsOnEdge PRESENTE */ int ud = originNode.Coords.Item1 - node.Coords.Item1; int vd = originNode.Coords.Item2 - node.Coords.Item2; (int, int) directionPtCoord = (originNode.Coords.Item1 + ud, originNode.Coords.Item2 + vd); if(!nodes.ContainsKey(directionPtCoord)) continue; Point3d directionPt = nodes[directionPtCoord].location; Point nextPt = GeodesicInitialValue.NextGeodesicPoint(srf, neighbours[0].location, directionPt); if (nextPt == null) { node.nodeState = ChebyshevNode.NodeState.OutOfSurface; continue; } node.location = nextPt.Location; node.nodeState = ChebyshevNode.NodeState.Real; ComponentIndex ci; double s, t; Vector3d normal; Point3d closestPt; bool isOnBrep = srf.ClosestPoint(node.location, out closestPt, out ci, out s, out t, 0.0, out normal); node.IsOnEdge = (isOnBrep && ci.ComponentIndexType == ComponentIndexType.BrepEdge); /* IsOnEdge IMPOSTATO QUI */ return true; } return false; }

  // *** METODO IdentifyBoundaryNodes (dalla V6.0) ***
  internal void IdentifyBoundaryNodes() { foreach (var kvp in nodes) { ChebyshevNode node = kvp.Value; if (!node.IsReal) continue; bool isBoundary = false; (int, int)[] neighborCoords = node.NeighboursCoords; for(int i = 0; i < 4; i++) { ChebyshevNode neighbor; if (!nodes.TryGetValue(neighborCoords[i], out neighbor) || neighbor == null || !neighbor.IsReal) { isBoundary = true; break; } } node.IsOnEdge = isBoundary; /* Sovrascrive il flag */ } }

  // CreateSurfaceEdgeNodes MODIFICATO per impostare ParentCoords
  internal void CreateSurfaceEdgeNodes() { double maxSqLength = (this.gridSpan + this.tolerance) * (this.gridSpan + this.tolerance); foreach (var n in this.nodes) { ChebyshevNode node = n.Value; if (!node.IsReal) continue; List<ChebyshevNode> oosNodes = node.OutOfSurfaceNeighbours; foreach (ChebyshevNode oosN in oosNodes) { (int, int) pt2Coords = node.GetMirrorNodeCoords(oosN.Coords); if (!this.nodes.ContainsKey(pt2Coords)) continue; ChebyshevNode pt2Node = this.nodes[pt2Coords]; if (pt2Node == null || !pt2Node.IsReal) continue; double u, v; Vector3d normal; srf.ClosestPoint(node.location, out _, out _, out u, out v, 10d, out normal); Vector3d y = pt2Node.location - node.location; Plane plane = new Plane(node.location, normal, y); BrepEdgeList edges = srf.Edges; List<Point3d> pts = new List<Point3d>(); for (int i = 0; i < edges.Count; i++) { CurveIntersections ci = Intersection.CurvePlane(edges[i].EdgeCurve, plane, 0.001d); if (ci!= null) foreach(IntersectionEvent intersection in ci) { if (!intersection.IsPoint) continue; pts.Add(intersection.PointA); } } if (pts.Count == 0) { continue; } Point3d closestIntersection = pts[0]; double minUVDist = (node.location - closestIntersection).SquareLength; for (int i = 1; i < pts.Count; i++) { double uvDist = (node.location - pts[i]).SquareLength; if (uvDist < minUVDist) { minUVDist = uvDist; closestIntersection = pts[i]; } } if ((node.location - closestIntersection).SquareLength > maxSqLength) { continue; } ChebyshevNode newEdgeNode = new ChebyshevNode(this, (oosN.Coords), closestIntersection); newEdgeNode.ParentCoords = node.Coords; /* Imposta ParentCoords */ node.AddExtensionNode(newEdgeNode); } } }

  // CalculateRowsAndColumns e resto invariati
  internal void CalculateRowsAndColumns() { foreach (var n in nodes) { ChebyshevNode node = n.Value; if (!node.IsReal) continue; List<ChebyshevNode> row; if (rows.TryGetValue(node.V, out row)) { row.Add(node); } else { rows.Add(node.V, new List<ChebyshevNode>()); rows[node.V].Add(node); } List<ChebyshevNode> column; if (columns.TryGetValue(node.U, out column)) { column.Add(node); } else { columns.Add(node.U, new List<ChebyshevNode>()); columns[node.U].Add(node); } } foreach (var r in rows) { List<ChebyshevNode> row = r.Value; ChebyshevNodeComparer uComparer = new ChebyshevNodeComparer(true); row.Sort(uComparer); } foreach (var c in columns) { List<ChebyshevNode> column = c.Value; ChebyshevNodeComparer vComparer = new ChebyshevNodeComparer(false); column.Sort(vComparer); } if(!nodes.ContainsKey((0,0)) || !nodes.ContainsKey((1,0))) return; Point3d origin = nodes[(0, 0)].location; origin = origin - Vector3d.ZAxis * origin.Z; Vector3d uDir = nodes[(1, 0)].location - nodes[(0, 0)].location; uDir = new Vector3d(uDir.X, uDir.Y, 0); uDir.Unitize(); Vector3d vDir = Vector3d.CrossProduct(Vector3d.ZAxis, uDir); foreach (var r in rows) { planarRows.Add(r.Key, new List<ChebyshevNode>()); foreach (var node in r.Value) { node.SetPlanarLocation(GetPlanarizedNodePosition(node, origin, uDir, vDir)); PlanarRows[r.Key].Add(node); } } foreach (var c in columns) { planarColumns.Add(c.Key, new List<ChebyshevNode>()); foreach (var node in c.Value) { node.SetPlanarLocation(GetPlanarizedNodePosition(node, origin, uDir, vDir)); PlanarColumns[c.Key].Add(node); } } foreach (var r in rows) { InsertPlanarizedEdgeNodes(r.Value, planarRows[r.Key], Axis.U, uDir); } foreach (var c in columns) { InsertPlanarizedEdgeNodes(c.Value, planarColumns[c.Key], Axis.V, vDir); } }
  internal Point3d GetPlanarizedNodePosition(ChebyshevNode node) { return new Point3d(node.Coords.Item1 * gridSpan, node.Coords.Item2 * gridSpan, 0d); }
  internal Point3d GetPlanarizedNodePosition(ChebyshevNode node, Point3d origin, Vector3d uDir, Vector3d vDir) { Point3d basePos = new Point3d(node.Coords.Item1 * gridSpan, node.Coords.Item2 * gridSpan, 0d); return origin + uDir * basePos.X + vDir * basePos.Y; }
  static internal List<Point3d> GetNodeLocationList(List<ChebyshevNode> nodes) { List<Point3d> posList = new List<Point3d>(); foreach (var node in nodes) if(node != null) posList.Add(node.location); return posList; }
  static internal List<Point3d> GetNodePlanarLocationList(List<ChebyshevNode> nodes) { List<Point3d> posList = new List<Point3d>(); foreach (var node in nodes) if(node != null && node.PlanarLocation.IsValid) posList.Add(node.PlanarLocation); return posList; }
  private enum Axis { U = 0, V = 1 }
  private void InsertPlanarizedEdgeNodes(List<ChebyshevNode> nodes, List<ChebyshevNode> planarNodes, Axis axis, Vector3d direction) { int fwd = (int)axis; int bwd = fwd + 2; List<ChebyshevNode> newPlanarNodes = new List<ChebyshevNode>(); for(int i = 0; i < nodes.Count; i++) { ChebyshevNode node = nodes[i]; ChebyshevNode planarNode = planarNodes[i]; ChebyshevNode bwdExtension = node.EdgeExtensions[bwd]; if (bwdExtension != null) { double length = (bwdExtension.location - node.location).Length; Vector3d d = direction * length; bwdExtension.SetPlanarLocation(planarNode.PlanarLocation - d); newPlanarNodes.Add(bwdExtension); } newPlanarNodes.Add(planarNode); ChebyshevNode fwdExtension = node.EdgeExtensions[fwd]; if (fwdExtension != null) { double length = (fwdExtension.location - node.location).Length; Vector3d d = direction * length; fwdExtension.SetPlanarLocation(planarNode.PlanarLocation + d); newPlanarNodes.Add(fwdExtension); } } planarNodes.Clear(); planarNodes.AddRange(newPlanarNodes); }
}

// --- CLASSE ChebyshevNode --- (Logica V5.4 + ParentCoords)
class ChebyshevNode { internal ChebyshevNet net; internal (int, int) coords; public (int, int) Coords { get => coords; } internal int U { get => coords.Item1; } internal int V { get => coords.Item2; } internal Point3d location; Point3d planarLocation = Point3d.Unset; internal Point3d PlanarLocation { get => planarLocation; } internal ChebyshevNode[] neighbours; public ChebyshevNode[] Neighbours { get => neighbours; } internal ChebyshevNode[] edgeExtensions; internal ChebyshevNode[] EdgeExtensions { get => edgeExtensions; }
  internal bool IsOnEdge { get; set; } // Impostato durante creazione (V5.4) E SOVRASCRITTO da IdentifyBoundaryNodes
  internal (int, int) ParentCoords { get; set; } = (-999, -999); // Impostato da CreateSurfaceEdgeNodes
  public (int, int)[] NeighboursCoords { get { (int, int)[] coords = new (int, int)[4]; coords[0] = (this.coords.Item1 + 1, this.coords.Item2); coords[1] = (this.coords.Item1, this.coords.Item2 + 1); coords[2] = (this.coords.Item1 - 1, this.coords.Item2); coords[3] = (this.coords.Item1, this.coords.Item2 - 1); return coords; } } public bool HasDiagonalNeighbours { get { bool previousExists = neighbours[neighbours.Length-1] != null; for (int i = 0; i < neighbours.Length; i++) { bool nodeExists = neighbours[i] != null; if(nodeExists && previousExists) return true; previousExists = nodeExists; } return false; } } internal List<ChebyshevNode> OutOfSurfaceNeighbours { get { List<ChebyshevNode> oosNodes = new List<ChebyshevNode>(); for (int i = 0; i < Neighbours.Length; i++) { if (Neighbours[i] != null && Neighbours[i].IsOutOfSurface) oosNodes.Add(Neighbours[i]); } return oosNodes; } } internal bool IsGhost { get => this.nodeState == NodeState.Ghost; } internal bool IsReal { get => this.nodeState == NodeState.Real; } internal bool IsOutOfSurface { get => this.nodeState == NodeState.OutOfSurface; } internal enum NodeState { Ghost = 0, Real = 1, OutOfSurface = 2 } internal NodeState nodeState;
  public ChebyshevNode(ChebyshevNet net, (int, int) coords) { this.net = net; this.coords = coords; this.neighbours = new ChebyshevNode[4]; this.edgeExtensions = new ChebyshevNode[4]; this.nodeState = NodeState.Ghost; this.IsOnEdge = false; }
  // Costruttore imposta IsOnEdge geometricamente (Logica V5.4)
  public ChebyshevNode(ChebyshevNet net, (int, int) coords, Point3d location) : this(net, coords) { this.location = location; this.nodeState = NodeState.Real; double edgeTolerance = Rhino.RhinoDoc.ActiveDoc.ModelAbsoluteTolerance; ComponentIndex ci; double s, t; Vector3d normal; Point3d closestPt; bool isOnBrep = net.srf.ClosestPoint(this.location, out closestPt, out ci, out s, out t, 0.0, out normal); if (isOnBrep && this.location.DistanceTo(closestPt) <= edgeTolerance) { this.IsOnEdge = (ci.ComponentIndexType == ComponentIndexType.BrepEdge); } else { this.IsOnEdge = false; } }
  internal void AddNeighbour((int, int) neighbourCoord, ChebyshevNode node) { (int, int)[] nCoords = NeighboursCoords; for (int i = 0; i < nCoords.Length; i++) { if(nCoords[i] == neighbourCoord) { neighbours[i] = node; break; } } }
  bool DiagonalNeighbours(out ChebyshevNode origin1, out ChebyshevNode origin2) { int previousIndex = neighbours.Length - 1; bool previousExists = neighbours[previousIndex] != null; for (int i = 0; i < neighbours.Length; i++) { bool nodeExists = neighbours[i] != null; if (nodeExists && previousExists) { origin1 = neighbours[previousIndex]; origin2 = neighbours[i]; return true; } previousIndex = i; previousExists = nodeExists; } origin1 = null; origin2 = null; return false; }
  // CreateGeometricNode imposta IsOnEdge geometricamente (Logica V5.4)
  internal void CreateGeometricNode(double gridSpan, Brep srf) { ChebyshevNode node1, node2; if(!DiagonalNeighbours(out node1, out node2)) return; Sphere s1 = new Sphere(node1.location, gridSpan); Sphere s2 = new Sphere(node2.location, gridSpan); Circle intCircle; SphereSphereIntersection ssi = Intersection.SphereSphere(s1, s2, out intCircle); if (ssi == SphereSphereIntersection.None) { this.nodeState = NodeState.OutOfSurface; return; } Curve circleNurbs = intCircle.ToNurbsCurve(); Point3d[] ptInts; Intersection.CurveBrep(circleNurbs, srf, 0.001d, out _, out ptInts); List<Point3d> intersections = ptInts.ToList(); (int, int) diagonalNodeCoords = GetDiagonalNodeCoords(node1.coords, node2.coords); List<Point3d> goodInts = new List<Point3d>(); if(net.nodes.ContainsKey(diagonalNodeCoords)) { for (int i = 0; i < intersections.Count; i++) { Point3d a = intersections[i]; Point3d b = net.nodes[diagonalNodeCoords].location; double tolerance = net.gridSpan * 0.1; if (!a.EpsilonEquals(b, tolerance)) { goodInts.Add(a); } } intersections = goodInts; } if(intersections.Count < 1) { this.nodeState = NodeState.OutOfSurface; return; } else if(intersections.Count < 2) { this.location = intersections[0]; ComponentIndex ci; double s, t; Vector3d normal; Point3d closestPt; bool isOnBrep = srf.ClosestPoint(this.location, out closestPt, out ci, out s, out t, 0.0, out normal); this.IsOnEdge = (isOnBrep && ci.ComponentIndexType == ComponentIndexType.BrepEdge); } else { double u1, v1, u2, v2; srf.ClosestPoint(node1.location, out _, out _, out u1, out v1, 10d, out _); Point2d p1 = new Point2d(u1, v1); int index = 0; srf.ClosestPoint(intersections[0], out _, out _, out u2, out v2, 10d, out _); Point2d p2 = new Point2d(u2, v2); double minDistance = (p1 - p2).SquareLength; for (int i = 1; i < intersections.Count; i++) { srf.ClosestPoint(intersections[i], out _, out _, out u2, out v2, 10d, out _); p2 = new Point2d(u2, v2); double newDistance = (p1 - p2).SquareLength; if (newDistance < minDistance) { index = i; minDistance = newDistance; } } this.location = intersections[index]; this.IsOnEdge = false; } this.nodeState = NodeState.Real; }
  internal List<T> DiagonalCouplesFunc<T>(Func<ChebyshevNode,ChebyshevNode,T> func) { List<T> results = new List<T>(); ChebyshevNode previousNode = neighbours[neighbours.Length - 1]; for (int i = 0; i < neighbours.Length; i++) { bool coupleExists = (neighbours[i] != null && neighbours[i].IsReal) && (previousNode != null && previousNode.IsReal); if (coupleExists) { results.Add(func(previousNode, neighbours[i])); } previousNode = neighbours[i]; } return results; }
  internal T[] OppositeCoupleFunc<T>(Func<ChebyshevNode,ChebyshevNode,T> func) { T[] results = new T[2]; ChebyshevNode n0, n1, n2, n3; n0 = neighbours[0]; n1 = neighbours[1]; n2 = neighbours[2]; n3 = neighbours[3]; if (n0 == null || !n0.IsReal) n0 = this.edgeExtensions[0]; if (n2 == null || !n2.IsReal) n2 = this.edgeExtensions[2]; if (n1 == null || !n1.IsReal) n1 = this.edgeExtensions[1]; if (n3 == null || !n3.IsReal) n3 = this.edgeExtensions[3]; if((n0 != null && n0.IsReal) && (n2 != null && n2.IsReal)) { results[0] = func(n0, n2); } if ((n1 != null && n1.IsReal) && (n3 != null && n3.IsReal)) { results[1] = func(n1, n3); } return results; }
  internal double NeighboursAngle(ChebyshevNode n0, ChebyshevNode n1) { Vector3d v0 = n0.location - this.location; Vector3d v1 = n1.location - this.location; return Vector3d.VectorAngle(v0, v1); }
  internal double GetAngle() { List<double> angles = this.DiagonalCouplesFunc<double>(NeighboursAngle); if(angles.Count == 0) return 0.0; angles.Sort(); return angles[0]; }
  internal double OppositesCurvature(ChebyshevNode n0, ChebyshevNode n1) { if (n0 == null || n1 == null) return 0.0; Circle circle = new Circle(n0.location, n1.location, this.location); if(circle.Radius < 0.001) return double.PositiveInfinity; return 1 / circle.Radius; }
  internal double[] GetCurvature() { double[] curvature = new double[] { 0d, 0d }; curvature = this.OppositeCoupleFunc(OppositesCurvature); return curvature; }
  internal void AddExtensionNode(ChebyshevNode node) { (int, int)[] nCoords = NeighboursCoords; for (int i = 0; i < nCoords.Length; i++) { if(nCoords[i] == node.Coords) { edgeExtensions[i] = node; break; } } }
  internal void SetPlanarLocation(Point3d pos) { planarLocation = pos; }
  internal (int, int) GetDiagonalNodeCoords((int, int) uv1, (int, int) uv2) { int ud1, vd1, ud2, vd2; ud1 = uv1.Item1 - coords.Item1; vd1 = uv1.Item2 - coords.Item2; ud2 = uv2.Item1 - coords.Item1; vd2 = uv2.Item2 - coords.Item2; int u, v; u = ud1 + ud2; v = vd1 + vd2; return (coords.Item1 + u, coords.Item2 + v); }
  internal (int, int) GetMirrorNodeCoords((int,int) uv) { int ud = coords.Item1 - uv.Item1; int vd = coords.Item2 - uv.Item2; return (coords.Item1 + ud, coords.Item2 + vd); }
}
# ---------- end simple_chebyshev_1_1 ----------

preview = CustomPreview(Geometry=[simple_chebyshev_1_1.Columns, simple_chebyshev_1_1.Rows], Material=swatch)

# ----
# Data Visualization
nodeangle = Data(simple_chebyshev_1_1.NodeAngle)
nodeucurvature = Data(simple_chebyshev_1_1.NodeUCurvature)
nodevcurvature = Data(simple_chebyshev_1_1.NodeVCurvature)
equals = Equality(FirstNumber=nodeangle, SecondNumber="0.5*Pi")  # -> Equality, Inequality
max = Maximum(A=nodeucurvature, B=nodevcurvature)
cull = CullPattern(List=nodeangle, CullPattern=equals.Inequality)
clean = CleanTree(RemoveNulls=True, RemoveInvalid=True, RemoveEmpty=invert(False), Tree=cull)
bnd = Bounds(Numbers=flatten(max))
bnd_2 = Bounds(Numbers=flatten(clean))
dedomain = DeconstructDomain(Domain=bnd)  # -> Start, End
dedomain_2 = DeconstructDomain(Domain=bnd_2)  # -> Start, End
gradient = Gradient(
    LowerLimit=dedomain.Start,
    UpperLimit=dedomain.End,
    Parameter=max,
    stops=[0: RGB(0, 142, 0), 0.5: RGB(254, 251, 0), 1: RGB(255, 38, 0)])
gradient_2 = Gradient(
    LowerLimit=dedomain_2.Start,
    UpperLimit=dedomain_2.End,
    Parameter=clean,
    stops=[0: RGB(0, 142, 0), 0.5: RGB(254, 251, 0), 1: RGB(255, 38, 0)])

# ----
# Node Angle Deviation
# v 2.0.0
preview_2 = CustomPreview(Geometry=simple_chebyshev_1_1.Net, Material=gradient_2)

# ----
# Data Visualization
# Node Curvature
preview_3 = CustomPreview(Geometry=simple_chebyshev_1_1.Net, Material=gradient)

# ----
# Planar Grid (to GFFT)
boundarycrv = Curve(simple_chebyshev_1_1.BoundaryCurve)
planarrods = Curve([simple_chebyshev_1_1.PlanarRows, simple_chebyshev_1_1.PlanarColumns])
Y = UnitY(Factor=move_planar_grid)
move_5 = Move(Geometry=planarrods, Motion=Y)  # -> flatten(Geometry), Transform
move_6 = Move(Geometry=boundarycrv, Motion=Y)  # -> Geometry, Transform
group = Group(Geometry=flatten([move_6.Geometry, move_5.Geometry]))

# ----
# Get Curve Costrain
number_slider_3 = Slider(0.05, range=0..0.1)
Z = UnitZ(Factor=number_slider_3)
xy = XYPlane(Origin=Point(0, 0, 0))
move_7 = Move(Geometry=xy, Motion=Z)  # -> Geometry, Transform
targetsrf = Surface(move2pt.Moved)
sec = BrepPlane(Brep=targetsrf, Plane=move_7.Geometry)  # -> Curves, Points
project = Project(Geometry=sec.Curves, Plane=PlaneXY(0, 0, 0))  # -> Geometry, Transform
move_8 = Move(Geometry=project.Geometry, Motion=Y)  # -> Geometry, Transform

tstat = TreeStatistics(Tree=simple_chebyshev_1_1.PlanarNet)  # -> Paths, Length, Count
move_9 = Move(Geometry=simple_chebyshev_1_1.PlanarNet, Motion=Y)  # -> Geometry, Transform
rods_nodes = TextTag(Location=move_9.Geometry, Text=graft(tstat.Paths))

# ----
# Nodes Indices
swatch_2 = ColourSwatch(SwatchColor=RGB(255, 255, 255))
rods_nodes_2 = TextTag(Location=simple_chebyshev_1_1.Net, Text=simple_chebyshev_1_1.Indices, Colour=swatch_2)
planar_grid_nodes = TextTag(Location=move_9.Geometry, Text=graft(tstat.Paths), Colour=swatch_2)

# ----
# Ground Pts Selection
pt_3 = Point(simple_chebyshev_1_1.GroundPts)
shift = ShiftList(List=pt_3, Shift=1, Wrap=True)
ln = Line(StartPoint=pt_3, EndPoint=shift)
len = Length(Curve=ln)
grid_span_4 = Number(grid_span)
smaller_2 = SmallerThan(FirstNumber=len, SecondNumber=expr("x*2", grid_span_4))  # -> SmallerThan, OrEqualTo
dispatch_2 = Dispatch(List=ln, DispatchPattern=smaller_2.SmallerThan)  # -> ListA, ListB
number_slider_4 = Slider(0.02, range=0..0.1)
join = JoinCurves(Curves=dispatch_2.ListA, Preserve=False)
number_slider_5 = Slider(1, range=0..1)
ext = ExtendCurve(Curve=join, Type=0, Start=number_slider_4, End=number_slider_4)
neg = Negative(Value=number_slider_4)
offset = OffsetCurve(Curve=ext, Distance=expr("x*2", number_slider_4), Corners=number_slider_5)
offset_2 = OffsetCurve(Curve=ext, Distance=expr("x*2", neg), Corners=number_slider_5)
end = EndPoints(Curve=offset)  # -> Start, End
end_2 = EndPoints(Curve=offset_2)  # -> Start, End
ln_2 = Line(StartPoint=end.Start, EndPoint=end_2.Start)
ln_3 = Line(StartPoint=end.End, EndPoint=end_2.End)
join_2 = JoinCurves(Curves=[ln_2, offset, offset_2, ln_3], Preserve=False)
Y_2 = UnitY(Factor=move_planar_grid)
move_10 = Move(Geometry=join_2, Motion=Y_2)  # -> Geometry, Transform
move_11 = Move(Geometry=pt_3, Motion=Y_2)  # -> Geometry, Transform

custom_preview = CustomPreview(Geometry=group, Material=ColourSwatch(SwatchColor=RGB(255, 254, 254)))
custom_preview_2 = CustomPreview(Geometry=move_8.Geometry, Material=ColourSwatch(SwatchColor=RGB(255, 0, 0)))
custom_preview_3 = CustomPreview(Geometry=move_10.Geometry, Material=ColourSwatch(SwatchColor=RGB(0, 93, 255)))

# ----
# Node Angle Deviation
# Minimize square grid angle deviation from 90°
nodeangle_2 = Data(simple_chebyshev_1_1.NodeAngle)
equals_2 = Equality(FirstNumber=nodeangle_2, SecondNumber="0.5*Pi")  # -> Equality, Inequality
cull_2 = CullPattern(List=nodeangle_2, CullPattern=equals_2.Inequality)
clean_2 = CleanTree(RemoveNulls=True, RemoveInvalid=True, RemoveEmpty=invert(False), Tree=cull_2)
avr = Average(Input=flatten(clean_2))
deg = Degrees(Radians=avr)
panel = Panel(deg)

# ---- group: Inverse value for maximizing instead of minimizing
division = Division(A="1", B=deg)

# ---- group: Assign weight
multiplication = Multiplication(A=division, B="1")

# ----
panel_2 = Panel(multiplication)
panel_3 = Panel(division)

# ----
# Angle Deviation Analysis
node_angle_deviation = Data(clean_2)
deg_2 = Degrees(Radians=node_angle_deviation)  # -> flatten(Degrees)
sort_2 = SortList(Keys=deg_2)  # -> Keys, ValuesA
avr_2 = Average(Input=deg_2)
item_3 = ListItem(List=sort_2.Keys, Index=0, Wrap=True)  # -> Item1, Item
roundd = RoundToDecimalPlace(NumberX=avr_2, DecimalPlace=2, RoundType=0)  # -> Rounded, Difference
roundd_2 = RoundToDecimalPlace(NumberX=item_3.Item1, DecimalPlace=2, RoundType=0)  # -> Rounded, Difference
roundd_3 = RoundToDecimalPlace(NumberX=item_3.Item, DecimalPlace=2, RoundType=0)  # -> Rounded, Difference
max_angle_deviation = Panel(roundd_2.Rounded)
average_angle_deviation = Panel(roundd.Rounded)
min_angle_deviation = Panel(roundd_3.Rounded)

# ----
# Min Curvature
# Max Curvature
# Node Angle Deviation
panel_4 = Panel(multiplication)

# ----
# Distance form max curvature
# Maximize difference from limit curvature of the bigger curvature value in order to minimize points with extreme curvature
nodeucurvature_2 = Data(simple_chebyshev_1_1.NodeUCurvature)
nodevcurvature_2 = Data(simple_chebyshev_1_1.NodeVCurvature)
merge_6 = Merge(Data1=nodeucurvature_2, Data2=nodevcurvature_2)  # -> flatten(Result)
equals_3 = Equality(FirstNumber=merge_6, SecondNumber="0")  # -> Equality, Inequality
cull_3 = CullPattern(List=merge_6, CullPattern=equals_3.Inequality)
sort_3 = SortList(Keys=cull_3)  # -> Keys, ValuesA
division_2 = Division(A="1", B="2.67")
item_4 = ListItem(List=sort_3.Keys, Index=0, Wrap=True)  # -> Item1, Item
panel_5 = Panel(division_2)
subtraction = Subtraction(A=division_2, B=item_4.Item1)

# ---- group: Assign weight
multiplication_2 = Multiplication(A=subtraction, B="5")

# ----
panel_6 = Panel(multiplication_2)

# ----
# Grid Maker
# Credits: Pietrangelo Califano, Pierfrancesco Corbo, Daniele Lancia
panel_7 = Panel(multiplication_2)

# ----
# Distance form minimum curvature
nodeucurvature_3 = Data(simple_chebyshev_1_1.NodeUCurvature)
nodevcurvature_3 = Data(simple_chebyshev_1_1.NodeVCurvature)
merge_7 = Merge(Data1=nodeucurvature_3, Data2=nodevcurvature_3)  # -> flatten(Result)
equals_4 = Equality(FirstNumber=merge_7, SecondNumber="0")  # -> Equality, Inequality
cull_4 = CullPattern(List=merge_7, CullPattern=equals_4.Inequality)
sort_4 = SortList(Keys=cull_4)  # -> Keys, ValuesA
item_5 = ListItem(List=sort_4.Keys, Index=0, Wrap=True)  # -> Item1, Item
subtraction_2 = Subtraction(A=item_5.Item, B="0")

# ---- group: Assign weight
multiplication_3 = Multiplication(A=subtraction_2, B="10")

# ----
panel_8 = Panel(multiplication_3)

# ----
# Maximize difference from 0 of the smaller curvature value in order to minimize flat points
panel_9 = Panel(multiplication_3)

# ---- group: Fitness value
addition_2 = Addition(A=multiplication_2, B=multiplication_3, C=multiplication)

# ----
# Current Fitness Value
panel_10 = Panel(addition_2)

# ----
# Optimization
panel_11 = Panel(addition_2)

# ----
# Curvature Radius
nodevcurvature_4 = Data(simple_chebyshev_1_1.NodeVCurvature)
nodeucurvature_4 = Data(simple_chebyshev_1_1.NodeUCurvature)
division_3 = Division(A="1", B=nodevcurvature_4)
division_4 = Division(A="1", B=nodeucurvature_4)
clean_3 = CleanTree(RemoveNulls=True, RemoveInvalid=True, RemoveEmpty=invert(False), Tree=division_3)
clean_4 = CleanTree(RemoveNulls=True, RemoveInvalid=True, RemoveEmpty=invert(False), Tree=division_4)
tstat_2 = TreeStatistics(Tree=clean_3)  # -> Paths, Length, Count
tstat_3 = TreeStatistics(Tree=clean_4)  # -> Paths, Length, Count
sort_5 = SortList(Keys=flatten(clean_3), ValuesA=tstat_2.Paths)  # -> Keys, ValuesA
sort_6 = SortList(Keys=flatten(clean_4), ValuesA=flatten(tstat_3.Paths))  # -> Keys, ValuesA
roundd_4 = RoundToDecimalPlace(NumberX=sort_6.Keys, DecimalPlace=2, RoundType=0)  # -> Rounded, Difference
concat = Concatenate(FragmentA=roundd_4.Rounded, FragmentB=sort_6.ValuesA)
x_rods = Panel(concat)

roundd_5 = RoundToDecimalPlace(NumberX=sort_5.Keys, DecimalPlace=2, RoundType=0)  # -> Rounded, Difference
concat_2 = Concatenate(FragmentA=roundd_5.Rounded, FragmentB=sort_5.ValuesA)

y_rods = Panel(concat_2)

item_6 = ListItem(List=sort_5.Keys, Index=0, Wrap=True)  # -> Item1, Item
roundd_6 = RoundToDecimalPlace(NumberX=item_6.Item1, DecimalPlace=2, RoundType=0)  # -> Rounded, Difference
roundd_7 = RoundToDecimalPlace(NumberX=item_6.Item, DecimalPlace=2, RoundType=0)  # -> Rounded, Difference
max_radius_y_rods = Panel(roundd_6.Rounded)
min_radius_y_rods = Panel(roundd_7.Rounded)

# ----
# Min/Max
item_7 = ListItem(List=sort_6.Keys, Index=0, Wrap=True)  # -> Item1, Item

item_8 = ListItem(List=sort_6.Keys, Index=0, Wrap=True)  # -> Item1, Item
roundd_8 = RoundToDecimalPlace(NumberX=item_7.Item1, DecimalPlace=2, RoundType=0)  # -> Rounded, Difference
roundd_9 = RoundToDecimalPlace(NumberX=item_7.Item, DecimalPlace=2, RoundType=0)  # -> Rounded, Difference
max_radius_x_rods = Panel(item_8.Item1)
min_radius_x_rods = Panel(item_8.Item)

sort_7 = SortList(Keys=flatten([clean_4, clean_3]))  # -> Keys, ValuesA
item_9 = ListItem(List=sort_7.Keys, Index=0, Wrap=True)  # -> Item1, Item
roundd_10 = RoundToDecimalPlace(NumberX=item_9.Item1, DecimalPlace=2, RoundType=0)  # -> Rounded, Difference
roundd_11 = RoundToDecimalPlace(NumberX=item_9.Item, DecimalPlace=2, RoundType=0)  # -> Rounded, Difference
min_radius = Panel(roundd_11.Rounded)
max_radius = Panel(roundd_10.Rounded)

max_radius_x_rods_2 = Panel(roundd_8.Rounded)
min_radius_x_rods_2 = Panel(roundd_9.Rounded)

# ----
# Curvature Radius Average
avr_3 = Average(Input=flatten(clean_4))
roundd_12 = RoundToDecimalPlace(NumberX=avr_3, DecimalPlace=2, RoundType=0)  # -> Rounded, Difference
mean_value_x_rods = Panel(roundd_12.Rounded)

avr_4 = Average(Input=flatten([clean_4, clean_3]))
roundd_13 = RoundToDecimalPlace(NumberX=avr_4, DecimalPlace=2, RoundType=0)  # -> Rounded, Difference
mean_value = Panel(roundd_13.Rounded)

avr_5 = Average(Input=flatten(clean_3))
roundd_14 = RoundToDecimalPlace(NumberX=avr_5, DecimalPlace=2, RoundType=0)  # -> Rounded, Difference
mean_value_y_rods = Panel(roundd_14.Rounded)

# ----
# Curvature Radii
# (sorted list)
max_radius_x_rods_3 = Panel(roundd_8.Rounded)
y_rods_2 = Panel(y_rods)
