# Grasshopper definition Officina.gh (Grasshopper 1.0.8)
# plug-ins: RhinoCodePluginGH, Pufferfish

# ----
# Custom
# Move Center Pt
# Rotate grid
move_center_point = MDSlider(
    SliderMode=0,
    slider_value=Point(0.3063411918, 0.4109566937, 0.5),
    x_domain=Domain(0, 1),
    y_domain=Domain(0, 1),
    z_domain=Domain(0, 1))
grid_dimension = ValueList({"25 cm": 0.25, "45 cm": 0.45, "50 cm": 0.50, "55 cm": 0.55, "60 cm": 0.60, "70 cm": 0.70, "100 cm": 1.00}, selected="50 cm")
# X Sistema pannello di controllo
# x Caselle fantasma con bacchette eliminate perché troppo corte
# X Sistema visualizzazione caselle e lettere
# X Correggi bug sopra sotto terzo disegno
# - Griglia e/o nomi moduli terzo disegno
# X Riorganizza la definizione
# - sovrapposizioni fori, inserisci threshold
# -overlapping secondo spessore bacchette
# - Prepara file Rhino con dimensioni corrette post-bake
# 
# - Ottimizza performance
angle = Slider(-22.21, range=-45..45)

# ----
# Method
list = ValueList({"Custom": 0, "Grid Maker": 1}, selected="Grid Maker")

custom_trim_geo = Curve(<curve referenced from the Rhino model>)

# ----
# Drawings
# Assembly Layout
move_drawing = Slider(70, range=0..100)
scale_factor = Slider(1.6, range=1..3)
text_offset = Slider(1.09, range=0..5)

hole_diameter = Slider(0.012, range=0..0.02)
custom_move = Slider(157, range=0..250)
scale_factor_2 = Slider(3.27, range=0..10)

# ----
# Move Rods and Dimensions
move_x = Slider(3.47, range=0..10)

# ----
# Bounding box for auto count
number_slider = Slider(1.3, range=1..2)

# ----
# Grid Maker
gm_geo = Geometry([<curve referenced from the Rhino model> x120])

# ----
# Generate Grid from Grid Maker output
# 04/09 Piero
# 
# Fornendo le geometrie output di GM, distingue il perimetro dalla maglia e ottiene automaticamente la posizione del punto centrale, la rotazione e il passo, ridisegnando la griglia con la stessa geometria di quella ottenuta da GM.
# 
# 10/09 Piero
# Aggiunto componente C# che trasforma il vettore di riferimento della griglia di gm in modo da avere sempre l'angolo giusto di rotazione.
# 
# 19/09 Piero
# Aggiunto componente C# per calcolare la moda dalla lista elle distanze tra i punti della griglia, così da ottenere in maniera più affidabile il passo della maglia importata da gridmaker
# Da migliorare:
# 
# - Cambiando metodo di generazione della maglia, cambia il pattern delle diagonali
# X Le diagonali centrali non vengono generate
# X Testa Grid Maker method con altre griglie
gm_grid = Geometry(gm_geo)
cls = Closed(Curve=gm_grid)  # -> Closed, Periodic
dispatch = Dispatch(List=gm_grid, DispatchPattern=cls.Closed)  # -> ListA, ListB
explode = Explode(Curve=dispatch.ListB, Recursive=True)  # -> flatten(Segments), flatten(Vertices)
area = Area(Geometry=dispatch.ListA)  # -> Area, Centroid
cullpt = CullDuplicates(Points=explode.Vertices, Tolerance=0.1, CullMode=1)  # -> Points, Indices, Valence
cp = ClosestPoint(Point=area.Centroid, Cloud=cullpt.Points)  # -> ClosestPoint, CPIndex, Distance
item = ListItem(List=cullpt.Points, Index=cp.CPIndex, Wrap=True)  # -> Item, Item1
vec2pt = Vector2Pt(PointA=item.Item, PointB=item.Item1, Unitize=False)  # -> Vector, Length
X = UnitX(Factor=item.Item)
shift = ShiftList(List=cullpt.Points, Shift=1, Wrap=True)
rotate_vector = CSharpScript(V=vec2pt.Vector)  # -> Q1; inputs V: Vector3d
# ---------- rotate_vector: C# ----------
// Grasshopper Script Instance
#region Usings
using System;
using System.Linq;
using System.Collections;
using System.Collections.Generic;
using System.Drawing;

using Rhino;
using Rhino.Geometry;

using Grasshopper;
using Grasshopper.Kernel;
using Grasshopper.Kernel.Data;
using Grasshopper.Kernel.Types;
#endregion

public class Script_Instance : GH_ScriptInstance
{
    #region Notes
    /* 
      Members:
        RhinoDoc RhinoDocument
        GH_Document GrasshopperDocument
        IGH_Component Component
        int Iteration

      Methods (Virtual & overridable):
        Print(string text)
        Print(string format, params object[] args)
        Reflect(object obj)
        Reflect(object obj, string method_name)
    */
    #endregion

  private void RunScript(Vector3d V, ref object Q1)
{
  // zero vector → restituisci com’è
  if (V.IsTiny(1e-12)) { Q1 = V; return; }

  double x = V.X, y = V.Y, z = V.Z;
  double xp, yp;

  if (x >= 0 && y >= 0)       { xp = x;   yp = y;   } // QI: nessuna rotazione
  else if (x < 0 && y >= 0)   { xp = y;   yp = -x;  } // QII: ruota -90°  → (y, -x)
  else if (x < 0 && y < 0)    { xp = -x;  yp = -y;  } // QIII: ruota 180° → (-x, -y)
  else /* x >= 0 && y < 0 */  { xp = -y;  yp = x;   } // QIV: ruota +90°  → (-y, x)

  Q1 = new Vector3d(xp, yp, z);
}

}
# ---------- end rotate_vector ----------
auto_grid_dimension = Distance(PointA=cullpt.Points, PointB=shift)
angle_2 = Angle(VectorA=X, VectorB=rotate_vector)  # -> Angle, Reflex
obtain_mode = CSharpScript(N=auto_grid_dimension)  # -> Mode, Count; inputs N: list of Double
# ---------- obtain_mode: C# ----------
// Grasshopper Script Instance
#region Usings
using System;
using System.Linq;
using System.Collections;
using System.Collections.Generic;
using System.Drawing;

using Rhino;
using Rhino.Geometry;

using Grasshopper;
using Grasshopper.Kernel;
using Grasshopper.Kernel.Data;
using Grasshopper.Kernel.Types;
#endregion

public class Script_Instance : GH_ScriptInstance
{
    #region Notes
    /* 
      Members:
        RhinoDoc RhinoDocument
        GH_Document GrasshopperDocument
        IGH_Component Component
        int Iteration

      Methods (Virtual & overridable):
        Print(string text)
        Print(string format, params object[] args)
        Reflect(object obj)
        Reflect(object obj, string method_name)
    */
    #endregion

    private void RunScript(List<double> N, ref object Mode, ref object Count)
{
    if (N == null || N.Count == 0)
    {
        Mode = double.NaN;
        Count = 0;
        return;
    }

    // Use LINQ to group values and count frequencies
    var grouped = N.GroupBy(x => x)
                   .Select(g => new { Value = g.Key, Count = g.Count() })
                   .OrderByDescending(g => g.Count)
                   .ThenBy(g => g.Value) // tie-break: smallest value
                   .ToList();

    var best = grouped.First();

    Mode = best.Value;
    Count = best.Count;
}
}
# ---------- end obtain_mode ----------
deg = Degrees(Radians=angle_2.Angle)  # -> flatten(Degrees)
custom_trim_geometry = Curve(custom_trim_geo)
gm_grid_center_pt = Point(flatten(cp.ClosestPoint))
custom_grid_maker = Data(list)
custom_rotate_grid = Number(angle)
gm_trim_geo = Geometry(flatten(dispatch.ListA))
gm_grid_dimension = Panel(obtain_mode.Mode)
trim_geo = StreamFilter(Gate=custom_grid_maker, Stream0=custom_trim_geometry, Stream1=gm_trim_geo)  # -> flatten(Stream)
grid_dimension_2 = StreamFilter(Gate=custom_grid_maker, Stream0=grid_dimension, Stream1=gm_grid_dimension)  # -> flatten(Stream)

# ----
# Bounding rectangle
trim_geometry = Curve(trim_geo)
area_2 = Area(Geometry=trim_geometry)  # -> Area, Centroid
scale = Scale(Geometry=trim_geometry, Center=area_2.Centroid, Factor=number_slider)  # -> Geometry, Transform
brec = BoundingRectangle(Geometry=scale.Geometry, Plane=PlaneXY(0, 0, 0), Axis=0, Slide=0, Union=True)  # -> Bounding, DimensionX, DimensionY
sort = SortList(Keys=[brec.DimensionX, brec.DimensionY])  # -> Keys, ValuesA
item_2 = ListItem(List=sort.Keys, Index=0, Wrap=True)  # -> Item1, Item

expression = Expression(x=deg, Expression="if(x>45, x-90 ,x)")

# ----
# CMMKM
# architettura e design
gm_grid_rotation = Panel(expression)
gm_grid_dim_m = Panel(gm_grid_dimension)

# ----
# Move custom center point
area_3 = Area(Geometry=brec.Bounding)  # -> Area, Centroid
t_vector = Vector(move_center_point)
move = Move(Geometry=area_3.Centroid, Motion=t_vector)  # -> Geometry, Transform
custom_center_point = Point(move.Geometry)

custom_center_point_2 = Point(custom_center_point)
gm_grid_rotation_2 = Panel(expression)
center_pt = StreamFilter(Gate=custom_grid_maker, Stream0=custom_center_point_2, Stream1=gm_grid_center_pt)  # -> flatten(Stream)
grid_rotation = StreamFilter(Gate=custom_grid_maker, Stream0=custom_rotate_grid, Stream1=gm_grid_rotation_2)  # -> flatten(Stream)

grid_dimension_3 = Number(grid_dimension_2)

# ----
# Grid to modules
add_cells = Slider(1.1, range=1..2)
move_x_2 = Slider(-2, range=-10..10)
move_y = Slider(-1, range=-10..10)
# Officina v.2.0.5
# Credits:
swatch = ColourSwatch(SwatchColor=RGB(0, 91, 148))

move_y_2 = Number(move_y)
move_x_3 = Number(move_x_2)

# ----
# Module Properties
rods_overlapping_m = Slider(0.38, range=0..1)
n_of_intersections_x_y = Slider(4, range=0..10)
rods_width = ValueList({"3 cm": .03, "4 cm": .04, "5 cm": .05, "5,6cm": .056, "6 cm": .06}, selected="5,6cm")
invert_up_down = BooleanToggle(False)

# ----
# Generate grid module
rods_connector_overlapping_m = Number(rods_overlapping_m)
rods_per_module_x_y = Number(n_of_intersections_x_y)
grid_span_m = Number(grid_dimension_2)
cluster = Cluster(overlapping=rods_connector_overlapping_m, grid_span=grid_span_m, rods_per_module=rods_per_module_x_y)
pt = Point(cluster)
n_of_rods = Addition(A=n_of_intersections_x_y, B="1")
pline = PolyLine(Vertices=flatten(pt), Closed=False)
series = Series(Start=0, Step=grid_dimension_2, Count=n_of_rods)
X_2 = UnitX(Factor=series)
len = Length(Curve=pline)
max_rod_lenght_m = Panel(len)
move_2 = Move(Geometry=pline, Motion=X_2)  # -> Geometry, Transform
path_mapper = PathMapper(move_2.Geometry, source="{A;B}", target="{1}")
curvepoint = PointOnCurve(path_mapper, parameter=0.5)
module_center = Average(Input=curvepoint)
rotate = Rotate(Geometry=move_2.Geometry, Angle=degrees(Slider(90, range=0..100)), Plane=module_center)  # -> Geometry, Transform
grid_module = Group(Objects=[move_2.Geometry, rotate.Geometry])

intersections_per_module = Number(n_of_intersections_x_y)
align_for_odd_int_per_module = Expression(x=intersections_per_module, y=grid_dimension_3, Expression="if(x%2=0, 0, y/2)")

# ----
# Dimensions
number_slider_2 = Slider(0.28, range=0..1)
number_slider_3 = Slider(0.055, range=0..0.1)

n_of_rods_x_y = Integer(n_of_rods)
grid_span = Number(grid_dimension_2)
cell_size = Multiplication(A=grid_span, B=n_of_rods_x_y)
brec_l = Number(item_2.Item1)
grid_count = Division(A=brec_l, B=cell_size)

add_cells_2 = Multiplication(A=grid_count, B=add_cells)

round_to_odd_number = Expression(x=add_cells_2, Expression="(Round((x-1)/2))*2+1")

# ----
# Fabrication Layout
swatch_2 = ColourSwatch(SwatchColor=RGB(0, 33, 66))

# ----
# Generate cutting grid
cell_size_2 = Number(cell_size)
sqgrid = Square(Plane=PlaneXY(0, 0, 0), Size=cell_size_2, ExtentX=round_to_odd_number, ExtentY=round_to_odd_number)  # -> Cells, Points
explode_2 = Explode(Curve=sqgrid.Cells, Recursive=True)  # -> flatten(Segments), Vertices
midpt = CurveMiddle(Curve=explode_2.Segments)
avr = Average(Input=midpt)
orient = Orient(Geometry=sqgrid.Cells, Source=avr, Target=center_pt)  # -> Geometry, Transform
center_pt_2 = Point(center_pt)

rotate_2 = Rotate(Geometry=orient.Geometry, Angle=degrees(grid_rotation), Plane=center_pt_2)  # -> Geometry, Transform

area_4 = Area(Geometry=rotate_2.Geometry)  # -> Area, Centroid

geo = Geometry(rotate_2.Geometry)

# ----
# Split up and down
xy = XYPlane(Origin=area_4.Centroid)
move_x_4 = Expression(x=align_for_odd_int_per_module, y=grid_dimension_3, z=move_x_3, Expression="x+(y*z)")
move_y_3 = Expression(x=align_for_odd_int_per_module, y=grid_dimension_3, z=move_y_2, Expression="x+(y*z)")
panel = Panel("""True
False""")
invbool = InvertBoolean(Boolean=panel)  # -> Inverted, Number
filter = StreamFilter(Gate=invert_up_down, Stream0=panel, Stream1=invbool.Inverted)

rotate_3 = Rotate(Geometry=xy, Angle=degrees(grid_rotation), Plane=area_4.Centroid)  # -> Geometry, Transform
deplane = DeconstructPlane(Plane=rotate_3.Geometry)  # -> Origin, XAxis, YAxis, ZAxis
amp = Amplitude(Vector=deplane.YAxis, Amplitude=move_y_3)
amp_2 = Amplitude(Vector=deplane.XAxis, Amplitude=move_x_4)

orient_2 = Orient(Geometry=grid_module, Source=module_center, Target=rotate_3.Geometry)  # -> Geometry, Transform
move_3 = Move(Geometry=geo, Motion=amp_2)  # -> Geometry, Transform
trim_grid = Move(Geometry=move_3.Geometry, Motion=amp)  # -> Geometry, Transform

move_4 = Move(Geometry=orient_2.Geometry, Motion=amp_2)  # -> Geometry, Transform
move_5 = Move(Geometry=move_4.Geometry, Motion=amp)  # -> Geometry, Transform

ungroup = Ungroup(Group=move_5.Geometry)
partition = PartitionList(List=ungroup, Size=expr("X+1", n_of_intersections_x_y))  # -> simplify(Chunks)
tstat = TreeStatistics(Tree=partition)  # -> Paths, Length, Count
dispatch_2 = Dispatch(List=tstat.Paths, DispatchPattern=[True, False])  # -> ListA, ListB
y_rods = TreeBranch(Tree=partition, Path=dispatch_2.ListB, MaintainPaths=True)
x_rods = TreeBranch(Tree=partition, Path=dispatch_2.ListA, MaintainPaths=True)
tstat_2 = TreeStatistics(Tree=x_rods)  # -> Paths, Length, Count
tstat_3 = TreeStatistics(Tree=y_rods)  # -> Paths, Length, Count
dispatch_3 = Dispatch(List=tstat_3.Paths, DispatchPattern=invert(filter))  # -> ListA, ListB
dispatch_4 = Dispatch(List=tstat_2.Paths, DispatchPattern=filter)  # -> ListA, ListB
y_up = TreeBranch(Tree=x_rods, Path=dispatch_4.ListA, MaintainPaths=True)  # -> simplify(Branch)
y_down = TreeBranch(Tree=x_rods, Path=dispatch_4.ListB, MaintainPaths=True)  # -> simplify(Branch)
x_down = TreeBranch(Tree=y_rods, Path=dispatch_3.ListA, MaintainPaths=True)  # -> simplify(Branch)
x_up = TreeBranch(Tree=y_rods, Path=dispatch_3.ListB, MaintainPaths=True)  # -> simplify(Branch)

trim_grid_2 = Geometry(trim_grid.Geometry)
y_up_2 = Geometry(y_up)
y_down_2 = Geometry(y_down)
x_up_2 = Geometry(x_down)
x_down_2 = Geometry(x_up)

swatch_3 = ColourSwatch(SwatchColor=RGB(255, 0, 0))  # disabled
swatch_4 = ColourSwatch(SwatchColor=RGB(0, 255, 255))  # disabled
y_up_3 = Geometry(y_up_2)  # disabled
x_up_3 = Geometry(x_up_2)  # disabled
x_down_3 = Geometry(x_down_2)  # disabled
y_down_3 = Geometry(y_down_2)  # disabled
preview = CustomPreview(Geometry=[y_up_3, x_up_3], Material=swatch_3)  # disabled
preview_2 = CustomPreview(Geometry=[y_down_3, x_down_3], Material=swatch_4)  # disabled

path_mapper_2 = PathMapper(y_up_2, source="{A;B}", target="{0;0;A;B}")
path_mapper_3 = PathMapper(x_down_2, source="{A;B}", target="{1;1;A;B}")
path_mapper_4 = PathMapper(x_up_2, source="{A;B}", target="{1;0;A;B}")
path_mapper_5 = PathMapper(y_down_2, source="{A;B}", target="{0;1;A;B}")

trim_grid_3 = CustomPreview(Geometry=[trim_grid_2, trim_geo], Material=swatch)

# ----
# Trim/Align Rods
# cambia in base a overlapping?
rotated_trim_geometry = Curve(trim_geometry)
merge = Merge(Data1=path_mapper_2, Data2=path_mapper_5, Data3=path_mapper_4, Data4=path_mapper_3)
boundary = BoundarySurfaces(Edges=rotated_trim_geometry)
rods = Geometry(merge)
scx = SurfaceCurve(Surface=boundary, Curve=rods)  # -> Curves, Points, UVPoints, Normals, Parameters, Tangents
clean = CleanTree(RemoveNulls=True, RemoveInvalid=True, RemoveEmpty=invert(False), Tree=scx.Curves)
trim = TrimTree(Tree=clean, Depth=1)
geo_2 = Geometry(trim)
overlapping = Number(rods_overlapping_m)
len_2 = Length(Curve=geo_2)
expression_2 = Expression(x=len_2, y=overlapping, Expression="if(x<y,false,true)")
trimmed_rods = CullPattern(List=geo_2, CullPattern=expression_2)
grid_rotation_2 = Number(grid_rotation)
trim_geo_2 = Curve(trim_geo)
area_5 = Area(Geometry=trim_geo_2)  # -> Area, Centroid
neg = Negative(Value=grid_rotation_2)

grid = CustomPreview(Geometry=scx.Curves, Material=ColourSwatch(SwatchColor=RGB(255, 255, 255)))

clean_2 = CleanTree(RemoveNulls=True, RemoveInvalid=True, RemoveEmpty=invert(False), Tree=trimmed_rods)

rotate_4 = Rotate(Geometry=clean_2, Angle=degrees(neg), Plane=area_5.Centroid)  # -> Geometry, Transform

trimmed_rods_2 = Geometry(rotate_4.Geometry)

# ----
# Obtain Module Center Pts
path_mapper_6 = PathMapper(trimmed_rods_2, source="{A;B;C;D}", target="{C;D}")
tstat_4 = TreeStatistics(Tree=path_mapper_6)  # -> Paths, Length, Count
trim_grid_4 = Geometry(trim_grid_2)
branch = TreeBranch(Tree=simplify(graft(trim_grid_4)), Path=tstat_4.Paths, MaintainPaths=True)
grid_rotation_3 = Number(grid_rotation)
area_6 = Area(Geometry=branch)  # -> Area, Centroid
trim_geo_center_pt = Point(area_5.Centroid)
neg_2 = Negative(Value=grid_rotation_3)
rotate_5 = Rotate(Geometry=area_6.Centroid, Angle=degrees(neg_2), Plane=trim_geo_center_pt)  # -> Geometry, Transform
trimmed_rods_3 = Geometry(trimmed_rods_2)
path_mapper_7 = PathMapper(
    rotate_5.Geometry,
    source=["{A;B}", "{A;B}", "{A;B}", "{A;B}"],
    target=["{0;0;A;B}", "{0;1;A;B}", "{1;0;A;B}", "{1;1;A;B}"])
tstat_5 = TreeStatistics(Tree=trimmed_rods_3)  # -> Paths, Length, Count
bbox = BoundingBox(Content=flatten(trimmed_rods_3), Plane=PlaneXY(0, 0, 0), UnionBox=True)  # -> Box, Box_2
bb_center = Area(Geometry=bbox.Box)  # -> Area, Centroid
branch_2 = TreeBranch(Tree=path_mapper_7, Path=tstat_5.Paths, MaintainPaths=True)
bb_center_2 = Point(bb_center.Centroid)
center_pts = Point(branch_2)

section_width = Number(rods_width)  # disabled
number_slider_4 = Slider(3, range=0..10)  # disabled
offcrv = OffsetCurve(Curve=trimmed_rods_2, Plane=PlaneXY(0, 0, 0), Distance=section_width, BothSides=invert(False), Kinks=0, CapType=1)  # disabled
trim_2 = TrimTree(Tree=offcrv, Depth=number_slider_4)  # disabled
bang = ExplodeTree(Data=trim_2)  # -> Branch0, Branch1, Branch2, Branch3; disabled
swatch_5 = ColourSwatch(SwatchColor=RGB(255, 0, 0))  # disabled
swatch_6 = ColourSwatch(SwatchColor=RGB(0, 255, 255))  # disabled
preview_3 = CustomPreview(Geometry=[bang.Branch0, bang.Branch2], Material=swatch_5)  # disabled
preview_4 = CustomPreview(Geometry=[bang.Branch1, bang.Branch3], Material=swatch_6)  # disabled

scale_factor_3 = Number(scale_factor_2)
center_pts_2 = Point(branch_2)
bb_center_3 = Point(bb_center.Centroid)
scale_2 = Scale(Geometry=center_pts_2, Center=bb_center_3, Factor=scale_factor_3)  # -> Geometry, Transform
# Fabrication Layout
trimmed_grid = Geometry(rotate_4.Geometry)
center_pts_3 = Point(branch_2)
orient_3 = Orient(Geometry=trimmed_grid, Source=center_pts_3, Target=scale_2.Geometry)  # -> Geometry, Transform
split = SplitTree(Data=orient_3.Geometry, Masks=flatten("{0;*;*;*}"))  # -> Positive, Negative
Y = UnitY(Factor=move_x)  # -> expr("-x", UnitVector)
X_3 = UnitX(Factor=move_x)
move_6 = Move(Geometry=split.Positive, Motion=Y)  # -> Geometry, Transform
move_7 = Move(Geometry=split.Negative, Motion=X_3)  # -> Geometry, Transform
entwine = Entwine(Branch00=orient_3.Geometry, Branch01=move_6.Geometry, Branch02=move_7.Geometry, FlattenInputs=True)
X_4 = UnitX(Factor=custom_move)
move_8 = Move(Geometry=entwine, Motion=X_4)  # -> Geometry, Transform

trimmed_grid_2 = Geometry(rotate_4.Geometry)
center_pts_4 = Point(branch_2)
scale_factor_4 = Number(scale_factor)
bb_center_4 = Point(bb_center.Centroid)
scale_3 = Scale(Geometry=center_pts_4, Center=bb_center_4, Factor=scale_factor_4)  # -> Geometry, Transform
orient_4 = Orient(Geometry=trimmed_grid_2, Source=center_pts_4, Target=scale_3.Geometry)  # -> Geometry, Transform

# ----
# Assembly Layout
X_5 = UnitX(Factor=move_drawing)
move_9 = Move(Geometry=orient_4.Geometry, Motion=X_5)  # -> Geometry, Transform
section_width_2 = Number(rods_width)
offcrv_2 = OffsetCurve(Curve=move_9.Geometry, Plane=PlaneXY(0, 0, 0), Distance=section_width_2, BothSides=invert(False), Kinks=0, CapType=1)
trim_3 = TrimTree(Tree=offcrv_2, Depth=Slider(3, range=0..10))
bang_2 = ExplodeTree(Data=trim_3)  # -> Branch0, Branch1, Branch2, Branch3
preview_5 = CustomPreview(Geometry=[bang_2.Branch0, bang_2.Branch2], Material=ColourSwatch(SwatchColor=RGB(255, 0, 0)))
preview_6 = CustomPreview(Geometry=[bang_2.Branch1, bang_2.Branch3], Material=ColourSwatch(SwatchColor=RGB(0, 255, 255)))

module_center_pts = Point(rotate_5.Geometry)
tstat_6 = TreeStatistics(Tree=module_center_pts)  # -> flatten(Paths), Length, Count
dpath = DeconstructPath(Branch=tstat_6.Paths)
dispatch_5 = Dispatch(List=flatten(dpath), DispatchPattern=[True, False])  # -> ListA, ListB
bnd = Bounds(Numbers=dispatch_5.ListA)
bnd_2 = Bounds(Numbers=dispatch_5.ListB)
range = Range(Domain=bnd, Steps=bnd)  # -> graft(Range)
range_2 = Range(Domain=bnd_2, Steps=bnd_2)
int = Integer(range_2)
int_2 = Integer(range)
grid_rotation_4 = Number(grid_rotation)
expression_3 = Expression(x=int_2, y=int, Expression="Format(\"{0};{1}\", x, y)")
trim_geo_center_pt_2 = Point(area_5.Centroid)
trim_grid_5 = Geometry(simplify(trim_grid_4))
neg_3 = Negative(Value=grid_rotation_4)
rotate_6 = Rotate(Geometry=trim_grid_5, Angle=degrees(neg_3), Plane=trim_geo_center_pt_2)  # -> graft(Geometry), Transform
branch_3 = TreeBranch(Tree=rotate_6.Geometry, Path=expression_3, MaintainPaths=True)
area_7 = Area(Geometry=branch_3)  # -> Area, Centroid
scale_factor_5 = Number(scale_factor)
bb_center_5 = Point(bb_center.Centroid)
scale_4 = Scale(Geometry=area_7.Centroid, Center=bb_center_5, Factor=scale_factor_5)  # -> Geometry, Transform
orient_5 = Orient(Geometry=branch_3, Source=area_7.Centroid, Target=scale_4.Geometry)  # -> Geometry, Transform
scale_5 = Scale(Geometry=orient_5.Geometry, Center=scale_4.Geometry, Factor=scale_factor_5)  # -> Geometry, Transform
move_10 = Move(Geometry=scale_5.Geometry, Motion=X_5)  # -> Geometry, Transform
area_8 = Area(Geometry=move_10.Geometry)  # -> Area, Centroid
trim_4 = TrimTree(Tree=area_8.Centroid, Depth=1)
flip = FlipMatrix(Data=trim_4)
item_3 = ListItem(List=trim_4, Index=0, Wrap=True)  # -> Item1, Item
item_4 = ListItem(List=flip, Index=0, Wrap=True)  # -> Item1, Item
dim = Dimensions(Surface=scale_5.Geometry)  # -> UDimension, flatten(VDimension)
geo_3 = Geometry(item_4.Item)
geo_4 = Geometry(item_3.Item1)
item_5 = ListItem(List=dim.VDimension, Index=0, Wrap=True)
text_offset_2 = Number(text_offset)
item_6 = ListItem(List=dim.VDimension, Index=0, Wrap=True)
text_offset_3 = Number(text_offset)
expression_4 = Expression(x=item_5, y=text_offset_2, Expression="(x/2)+y")
expression_5 = Expression(x=item_6, y=text_offset_3, Expression="(x/2)+y")
Y_2 = UnitY(Factor=1)
X_6 = UnitX(Factor=1)
amp_3 = Amplitude(Vector=Y_2, Amplitude=expression_4)
amp_4 = Amplitude(Vector=X_6, Amplitude=expression_5)
move_11 = Move(Geometry=geo_4, Motion=amp_3)  # -> Geometry, Transform
move_12 = Move(Geometry=geo_3, Motion=expr("-x", amp_4))  # -> Geometry, Transform
lng = ListLength(List=flatten(move_11.Geometry))
lng_2 = ListLength(List=flatten(move_12.Geometry))
series_2 = Series(Start=0, Step=1, Count=lng)
charseq = CharSequence(Count=lng, CharPool="ABCDEFGHIJKLMNOPQRSTUVWXYZ", Format="{0}")
series_3 = Series(Start="1", Step=1, Count=lng_2)
text_entity = TextEntity(Plane=move_12.Geometry, Text=reverse(graft(series_3)))  # -> TextEntity, Plane, Text
rep = ReplaceText(Text=series_2, Find=series_2, Replace=charseq, RecursiveReplace=False)
text_entity_2 = TextEntity(Plane=move_11.Geometry, Text=graft(rep))  # -> TextEntity, Plane, Text

trim_grid_6 = CustomPreview(Geometry=[move_10.Geometry, text_entity.TextEntity, text_entity_2.TextEntity], Material=swatch_2)
up = CustomPreview(Geometry=[bang_2.Branch0, bang_2.Branch2], Material=ColourSwatch(SwatchColor=RGB(255, 0, 0)))
down = CustomPreview(Geometry=[bang_2.Branch1, bang_2.Branch3], Material=ColourSwatch(SwatchColor=RGB(0, 255, 255)))

explode_3 = Explode(Curve=move_8.Geometry, Recursive=True)  # -> Segments, Vertices
panel_2 = Panel("""-1
0""")
cull_i = CullIndex(List=explode_3.Vertices, Indices=panel_2, Wrap=True)
hole_diameter_2 = Number(expr("x/2", hole_diameter))
circle = CircleCNR(Center=cull_i, Normal=Vector(0, 0, 1), Radius=hole_diameter_2)  # -> simplify(Circle)
trim_5 = TrimTree(Tree=circle, Depth=1)

split_2 = SplitTree(Data=explode_3.Segments, Masks=flatten("{0;0;*}"))  # -> Positive, Negative
join = JoinCurves(Curves=flatten(split_2.Negative), Preserve=False)
end = EndPoints(Curve=split_2.Negative)  # -> Start, End
end_2 = EndPoints(Curve=join)  # -> Start, End

holes_dim = AlignedDimension(
    Plane=PlaneXY(0, 0, 0),
    PointA=end.Start,
    PointB=end.End,
    Offset=expr("x/2", number_slider_2),
    Text="{0:0.00}",
    Size=number_slider_3)
rods_dim = AlignedDimension(
    Plane=PlaneXY(0, 0, 0),
    PointA=end_2.Start,
    PointB=end_2.End,
    Offset=number_slider_2,
    Text="{0:0.00}",
    Size=number_slider_3)

section_width_3 = Number(rods_width)
offcrv_3 = OffsetCurve(Curve=move_8.Geometry, Plane=PlaneXY(0, 0, 0), Distance=section_width_3, BothSides=invert(False), Kinks=0, CapType=1)

preview_7 = CustomPreview(Geometry=[offcrv_3, trim_5], Material=ColourSwatch(SwatchColor=RGB(0, 0, 0)))

# ==== cluster Cluster
overlapping = ClusterInput()  # Rods connector overlapping (m)
rods_per_module = ClusterInput()  # Defines the number of rods in the X and Y directions that compose each module of the grid.
grid_span = ClusterInput()  # Defines the span of the planar grid (m)
expression = Expression(S=grid_span, R=rods_per_module, O=overlapping, Expression="O+(S*R)")  # -> graft(R)
series = Series(Start=overlapping, Step=grid_span, Count=rods_per_module)
merge = Merge(Data1="0", Data2=series, Data3=expression)
pt = ConstructPoint(XCoordinate=0, YCoordinate=flatten(merge), ZCoordinate=0)
item = ListItem(List=pt, Index=0, Wrap=True)  # -> Item1, Item
dist = Distance(PointA=item.Item, PointB=item.Item1)
S = Data(overlapping)
addition = Addition(A=dist, B=S)
pt_2 = ConstructPoint(XCoordinate=0, YCoordinate=addition, ZCoordinate=0)
pt_3 = ClusterOutput([pt, pt_2])
